vi "Inspect TDMS File.gvi"   [LabVIEW Communications System Design Software 2.0.1]
panel indicators:
  "Groups and Channels": string[][]
diagram:
  # Use File Dialog to choose a
  # TDMS file from disk.
  File Dialog[FileDialogSelectionMode=File, NewOrExistingMode=New](pattern (all files)="*.tdms", prompt="Choose a TDMS File") -> (error out=w1, selected path=w2)
  # Open a TDMS session.
  TDMS Open(error in=w1, file path=w2) -> (error out=w3, tdms file out=w4)
  # List all groups
  # in the file.
  TDMS List Contents(error in=w3, tdms file=w4) -> (error out=w5, group names=w6, tdms file out=w7)
  Array Size(array=w6) -> (size(s)=w8)
  s1 = w7  # shift register
  s2 = string[][] []  # shift register
  s3 = w5  # shift register
  for (N = w8) {
    w9 = each element of w6
    # List channels
    # for this group.
    TDMS List Contents(error in=s3, group name=w9, tdms file=s1) -> (error out=w10, group names=w11, group/channel names=w12, tdms file out=w13)
    for {
      w14 = each element of w12
      # First column is empty.
      # Second column is channel name.
      Build Array(EmptyString, w14) -> w16
      append w16 to w15
    }
    # First column is group name
    # Second column is empty.
    Build Array(w11, EmptyString) -> w17
    # For each group, list all the channels in the
    # group and create a 2D array for display with
    # the first column showing the groups and the
    # second column showing the channels.
    # Append array.
    Build Array[ConcatenateInputs=True](s2, w17, w15) -> w18
    next s1 = w13
    next s2 = w18
    next s3 = w10
  }
  $"Groups and Channels" <- s2
  # Close the TDMS session.
  TDMS Close(error in=s3, tdms file=s1) -> (error out=w19)
  # Display any errors.
  call "Display Error.gvi"(error in=w19)
