vi "testrecord.gvi"   [LabVIEW Communications System Design Software 2.0.1]
panel controls:
  "loop count": i32
  "Cluster": T2 = {"samples"=1000, "sample rate"=1000, "frequency"=10, "threshold"=0}
panel indicators:
  "size(s)": i32
  "Array": string[]
  "Graph": waveform<f64>[]
  "indices": i32[]
  "num groups over threshold": i32
  "power spectrum": T1
  "Graph_2": T1
  "Freqs at Pk Power": f64[]
types:
  T1 = cluster{"f0": f64, "df": f64, "magnitude": f64[]}
  T2 = cluster{"samples": i32, "sample rate": f64, "frequency": f64, "threshold": f64}
uses:
  NI::Analysis::Generation::Square Waveform.gvi
  NI::Analysis::Generation::Sine Waveform.gvi
  NI::Analysis::Measurement::Power Spectrum for 1 Chan.gvi
  NI::Analysis::Measurement::Threshold Detector.gvi
diagram:
  call "Square Waveform.gvi"() -> (square wave=w1)
  Property Node(instance in=$Cluster) -> ("samples"=w2, "sample rate"=w3, "frequency"=w4, "threshold"=w5)
  call "Sine Waveform.gvi"(amplitude=1, frequency=w4, sample rate=w3, samples=w2) -> (sine wave=w6)
  Build Array(w1, w6) -> w7
  $Graph <- w7
  w8 = $"loop count"
  Get Component Directory() -> (Path=w9)
  # cwd
  Build Path(base path=w9, name or relative path=path "test_data.tdms") -> (appended path=w10)
  TDMS Open(file path=w10, operation="create or replace") -> (error out=w11, tdms file out=w12)
  for (N = w8) (iteration -> i1) {
    Build Array(w1, w6) -> w13
    Format Into String(initString="Group", i1) -> w14
    Array Size(array=w13) -> (size(s)=w15)
    for (N = w15) (iteration -> i2) {
      Format Into String(initString="Channel", i2) -> w17
      append w17 to w16
    }
    TDMS Write(channel name(s) in=w16, data=w13, error in=w11, group name in=w14, tdms file=w12) -> (error out=w18, tdms file out=w19)
    $"size(s)" <- w15
    # I read this is the best way
    # to initialize arrays.
    $Array <- w16
  }
  TDMS Close(error in=w18, tdms file=w19) -> (error out=w20)
  call "Display Error.gvi"(error in=w20)
  call "Power Spectrum for 1 Chan.gvi"(signal=w6, dB on=TRUE) -> (power spectrum=w21)
  $"power spectrum" <- w21
  $Graph_2 <- w21
  Property Node(instance in=w21) -> ("df"=w22, "magnitude"=w23)
  # w22: note, df = sample rate / samples
  call "Threshold Detector.gvi"(signal=w23, threshold=w5, width=1) -> (indices=w24, count=w25)
  Multiply(w22, w24) -> w26
  $"Freqs at Pk Power" <- w26
  $indices <- w24
  $"num groups over threshold" <- w25
