vi "(Edited) Power Spectrum for 1 Chan (CDB).gvi"   [LabVIEW Communications System Design Software 2.0.1]
inputs:
  "window parameter": f64 = NaN
  "restart averaging": bool
  "error in": error
  "dB on": bool
  "averaging parameters": "Averaging Parameters.gtype" = {"averaging mode"="No averaging", "weighting mode"="Exponential", "number of averages"=10}  # averaging parameters defines how the averaging is computed. The specifications of the parameters include the type of averaging, the type of weighting, and the number of averages.
  "window type": "windowTd.gtype" = "Hanning"(1)
  "signal": waveform<c128> = {dt=1, Y=[]}
outputs:
  "error out": error
  "averages completed": f64
  "power spectrum averaged": T1
  "averaging done": bool
  "power spectrum current": T3
types:
  T1 = cluster{"f0": f64, "df": f64, "magnitude": f64[]}
  T2 = enum{"No averaging", "Vector averaging", "RMS averaging", "Peak hold"}
  "Averaging Parameters.gtype" = cluster{"averaging mode": T2, "weighting mode": enum{"Linear", "Exponential"}, "number of averages": u32}
  "windowTd.gtype" = u32
  T3 = cluster{"f0": f64, "df": f64, "spectrum in dB": f64[]}
  T4 = cluster{"averaging mode": T2, "weighting mode": enum{"Linear", "Exponential"}, "number of averages": u32}
  T5 = cluster{"averaging parameters": T4, "window": "windowTd.gtype"}
  T6 = cluster{"block size": i32, "dt": f64, "spectrum parameters": T5, "df": f64, "averages completed": f64, "complex spectrum": c128[], "real spectrum": f64[], "t0 history": f64, "dt history": f64, "timestamp": f64, "lin avg done": bool}
diagram:
  case ($"error in") {
    frame No Error {
      Is First Call() -> w6
      Logical Or($"restart averaging", w6) -> w7
      s1 = uninitialised  # shift register
      while {
        Select(s=w7, t=T6 {all zero or empty}, f=s1) -> w8
        call "(Edited) ma_FFT Power Spectrum and PS Density no State (CDB).gvi"(dB On (F)=$"dB on", window parameter=$"window parameter", window=$"window type", averaging parameters=$"averaging parameters", time signal=$signal, restart averaging (F)=w7, state info=w8, Error In=$"error in", ps density=FALSE) -> (Error Out=w1, state info out=w9, averaging done=w2, averages completed=w4, power spectrum averaged=w3, power spectrum current=w5)
        next s1 = w9
        continue if FALSE
      }
    }
    frame Error {
      w1 = $"error in"
      w2 = default
      w3 = default
      w4 = default
      w5 = default
    }
  }
  $"averaging done" <- w2
  $"power spectrum averaged" <- w3
  $"power spectrum current" <- w5
  $"averages completed" <- w4
  $"error out" <- w1
