vi "(Edited) ma_FFT Power Spectrum and PS Density no State (CDB).gvi"   [LabVIEW Communications System Design Software 2.0.1]
inputs:
  "dB On (F)": bool
  "window parameter": f64 = NaN
  "window": "windowTd.gtype" = "Hanning"(1)
  "averaging parameters": "Averaging Parameters.gtype"  # averaging parameters defines how the averaging is computed. The specifications of the parameters include the type of averaging, the type of weighting, and the number of averages.
  "time signal": waveform<c128>
  "restart averaging (F)": bool
  "state info": T5
  "Error In": error
  "ps density": bool
outputs:
  "Error Out": error
  "state info out": T5
  "averaging done": bool
  "averages completed": f64
  "power spectrum averaged": T1
  "power spectrum current": T6
types:
  T1 = cluster{"f0": f64, "df": f64, "magnitude": f64[]}
  T2 = enum{"No averaging", "Vector averaging", "RMS averaging", "Peak hold"}
  T3 = cluster{"averaging mode": T2, "weighting mode": enum{"Linear", "Exponential"}, "number of averages": u32}
  "windowTd.gtype" = u32
  T4 = cluster{"averaging parameters": T3, "window": "windowTd.gtype"}
  T5 = cluster{"block size": i32, "dt": f64, "spectrum parameters": T4, "df": f64, "averages completed": f64, "complex spectrum": c128[], "real spectrum": f64[], "t0 history": f64, "dt history": f64, "timestamp": f64, "lin avg done": bool}
  "Averaging Parameters.gtype" = cluster{"averaging mode": T2, "weighting mode": enum{"Linear", "Exponential"}, "number of averages": u32}
  T6 = cluster{"f0": f64, "df": f64, "spectrum in dB": f64[]}
  T7 = cluster{"Literal": f64, "df": f64, "ArrayLiteral": f64[]}
uses:
  NI::Analysis::Measurement::ma_Check Block Size no State (CDB).gvi
  NI::Analysis::Measurement::ma_Force Restart no State.gvi
  NI::Analysis::Measurement::Scaled Window for 1 Chan (CDB).gvi
  NI::Analysis::Measurement::ma_Two-sided Power Spectrum (CDB).gvi
  NI::Analysis::Measurement::ma_Two-sided FFT Spectrum (CDB).gvi
  NI::Analysis::Measurement::ma_Spectrum Averaging (complex) no State.gvi
  NI::Analysis::Measurement::ma_Linear Averaging Done.gvi
  NI::Analysis::Measurement::ma_Spectrum Averaging (real) no State.gvi
  NI::Analysis::Measurement::ma_Spectrum Peak Hold no State.gvi
  NI::Analysis::Measurement::ma_Convert to dB.gvi
  NI::Analysis::Support::ma_patchErrorCode or Caller as Source.gvi
diagram:
  call "ma_Check Block Size no State (CDB).gvi"(time signal=$"time signal", restart averaging (F)=$"restart averaging (F)", Error In=$"Error In", averaging parameters=$"averaging parameters", state info=$"state info") -> (force restart averaging=w1, Error Out=w2, state info 2=w3)
  case (w2) {
    frame No Error {
      Property Node(instance in=$"averaging parameters") -> ("averaging mode"=w10)
      call "ma_Force Restart no State.gvi"(averaging parameters=$"averaging parameters", window=$window, restart averaging (F)=$"restart averaging (F)", force restart averaging in=w1, state info=w3) -> (skip processing=w11, force restart averaging=w12, retrieve last spectrum=w13, Error Out=w14, state info 2=w15)
      call "Scaled Window for 1 Chan (CDB).gvi"(signal=$"time signal", window type=$window, window parameter=$"window parameter", error in=w11) -> (windowed signal=w16, window properties=w17)
      Property Node(instance in=w16) -> ("Y"=w18, "dt"=w19)
      case (w10) {
        frame "No averaging", Default {
          call "ma_Two-sided Power Spectrum (CDB).gvi"(signal (V)=w18, dt=w19) -> (power spectrum (V^2 rms)=w21, df=w20, f0=w24)
          w4 = 1
          w5 = TRUE
          w22 = FALSE
          w23 = w15
          w25 = w21
        }
        frame "Vector averaging" {
          call "ma_Two-sided FFT Spectrum (CDB).gvi"(signal (V)=w18, dt=w19) -> (FFT spectrum (Vrms)=w26, df=w27, f0=w24)
          Complex To Polar(r * e^(i*theta)=w26) -> (r=w28)
          Multiply(w28, w28) -> w25
          call "ma_Spectrum Averaging (complex) no State.gvi"(complex spectrum=w26, df=w27, averaging parameters=$"averaging parameters", restart averaging (F)=w12, retrieve last spectrum (F)=w13, state info=w15) -> (averages completed=w4, averaged complex spectrum=w29, df out=w20, averaging done=w5, state info out=w23)
          Complex To Polar(r * e^(i*theta)=w29) -> (r=w30)
          Multiply(w30, w30) -> w21
          call "ma_Linear Averaging Done.gvi"(averaging done=w5, averaging parameters=$"averaging parameters") -> (linear averaging done=w22)
        }
        frame "RMS averaging" {
          call "ma_Two-sided Power Spectrum (CDB).gvi"(signal (V)=w18, dt=w19) -> (power spectrum (V^2 rms)=w25, df=w31, f0=w24)
          call "ma_Spectrum Averaging (real) no State.gvi"(real spectrum=w25, df=w31, averaging parameters=$"averaging parameters", restart averaging (F)=w12, retrieve last spectrum (F)=w13, state info=w15) -> (state info out=w23, averaged real spectrum=w21, df out=w20, averaging done=w5, averages completed=w4)
          call "ma_Linear Averaging Done.gvi"(averaging done=w5, averaging parameters=$"averaging parameters") -> (linear averaging done=w22)
        }
        frame "Peak hold" {
          call "ma_Two-sided Power Spectrum (CDB).gvi"(signal (V)=w18, dt=w19) -> (power spectrum (V^2 rms)=w25, df=w20, f0=w24)
          call "ma_Spectrum Peak Hold no State.gvi"(real spectrum=w25, averaging parameters=$"averaging parameters", restart averaging (F)=w12, state info=w15) -> (peak spectrum=w21, averaging done=w5, averages completed=w4, state info out=w23)
          w22 = FALSE
        }
      }
      Property Node(instance in=w17) -> ("eq noise BW"=w32)
      case ($"ps density") {
        frame False, Default {
          w33 = w25
        }
        frame True {
          Multiply(w20, w32) -> w34
          Divide(x=w25, y=w34) -> w33
        }
      }
      case ($"dB On (F)") {
        frame False, Default {
          w35 = w33
        }
        frame True {
          call "ma_Convert to dB.gvi"(spectrum=w33, spectrum type="Power spectrum") -> (spectrum in dB=w35)
        }
      }
      Property Node(instance in=T6 {all zero or empty}, "f0"=w20, "df"=w32, "spectrum in dB"=w35) -> (instance out=w9)
      case ($"ps density") {
        frame False, Default {
          w36 = w21
        }
        frame True {
          Multiply(w20, w32) -> w37
          Divide(x=w21, y=w37) -> w36
        }
      }
      case ($"dB On (F)") {
        frame False, Default {
          w38 = w36
        }
        frame True {
          call "ma_Convert to dB.gvi"(spectrum=w36, spectrum type="Power spectrum") -> (spectrum in dB=w38)
        }
      }
      Property Node(instance in=T6 {all zero or empty}, "f0"=w24, "df"=w20, "spectrum in dB"=w38) -> (instance out=w7)
      Property Node(instance in=w23, "lin avg done"=w22) -> (instance out=w8)
      Merge Errors(w14, w2) -> (error out=w39)
      call "ma_patchErrorCode or Caller as Source.gvi"(operation=1, error in (no error)=w39) -> (Error Out=w6)
    }
    frame Error {
      w4 = 0
      w5 = FALSE
      w6 = w2
      w7 = T7 {all zero or empty}
      w8 = w3
      w9 = T7 {all zero or empty}
    }
  }
  $"power spectrum current" <- w9
  $"power spectrum averaged" <- w7
  $"averaging done" <- w5
  $"averages completed" <- w4
  $"state info out" <- w8
  $"Error Out" <- w6
