vi "Aggregate Spectrum.gvi"   [LabVIEW Communications System Design Software 2.0.1]
panel controls:
  "RX Parameters In": T1
  "Device Names": "niUSRPClass"
  "Averaging Parameters": "Averaging Parameters.gtype" = {"averaging mode"="No averaging", "weighting mode"="Exponential", "number of averages"=10}  # averaging parameters defines how the averaging is computed. The specifications of the parameters include the type of averaging, the type of weighting, and the number of averages.
  "Display": T4 = {"display unit"="Vrms", "dB type"="dB"}
  "Stop Capture": bool = TRUE
  "threshold": f64
  "Tab": i32
panel indicators:
  "error out": error
  "FFT Power Spectrum": cluster{"f0": f64, "df": f64, "IQ": f64[]}
  "Samples per Acquisition": i64
  "Carrier Freq Out": f64
  "Freqs above threshold": f64[]
  "indices": i32[]
  "count": i32
types:
  T1 = cluster{"IQ Sampling Rate [S/sec]": f64, "Gain [dB]": f64, "Active Antenna": string, "Reference Frequency": string, "Timebase Clock Source": string, "Start Carrier [Hz]": f64, "Stop Carrier [Hz]": f64, "Acq Duration [sec]": f64}
  T2 = enum{"No averaging", "Vector averaging", "RMS averaging", "Peak hold"}
  "Averaging Parameters.gtype" = cluster{"averaging mode": T2, "weighting mode": enum{"Linear", "Exponential"}, "number of averages": u32}
  T3 = enum{"Vrms", "Vpk", "Vrms^2", "Vpk^2", "Vrms/rtHz", "Vpk/rtHz", "Vrms^2/Hz", "Vpk^2/Hz"}
  T4 = cluster{"display unit": T3, "dB type": enum{"Linear", "dB", "dBm"}}
diagram:
  call "niUSRP Open Rx Session.gvi"(device names=$"Device Names") -> (error out=w1, session handle out=w2)
  call "Set Parameters.gvi"(RX Parameters In=$"RX Parameters In", IVI Refnum In=w2, error in (no error)=w1) -> (error out: HW RX Param subsetup=w3, IVI Refnum Out=w4, Test Carrier Frequencies=w5, Samples per Acquisition=w6, Frame Parameters Out=w7)
  Property Node(instance in=$"Averaging Parameters") -> ("number of averages"=w8, instance out=w9)
  call "niUSRP Configure Number of Samples.gvi"(session handle=w4, number of samples is finite=TRUE, number of samples=w6, error in=w3) -> (session handle out=w10, error out=w11)
  To Long Integer(number=w8) -> w12
  w13 = $Display
  while {
    # Restart at first carrier after end
    s1 = w5  # shift register
    for (iteration -> i1) {
      w14 = each element of w5
      # Get new carrier frequency
      for (N = w12) (iteration -> i2) {
        w15 = each element of s1
        call "Set Carrier and LO.gvi"(Current Frequency=w14, LO Frequency=w15, niusrp in_2=w10, error in=w11) -> (Usrp.niUSRPClass=w17, Error=w18)
        # Averaging Loop
        call "Read Data.gvi"(USRP Session Handle In=w17, error in=w18, Number of Samples=w6) -> (USRP Session Handle Out=w19, error out=w20, data=w21)
        # w22: First Rx for this carrier?
        Is Equal To 0(x=i2) -> w22
        call "USRP Aggregate Spectrum.gvi"(Frame Parameters=w7, Input Baseband IQ=w21, Iteration=i1, Averaging Parameters=w9, Restart Averaging=w22) -> (Window Properties=w23, error out=w24, Spectrum to Plot=w25, Frame Parameters Out=w26)
        Merge Errors(w20, w24) -> (error out=w27)
        Property Node(instance in=w19, error in=w27) -> ("Carrier Frequency"=w28, "LO Frequency"=w29, error out=w30, instance out=w31)
        Logical Or($"Stop Capture", w30) -> w32
        $"Carrier Freq Out" <- w28
        call "USRP Plot Spectrum.gvi"(Frame Parameters=w26, Display=w13, Window Properties=w23, Spectrum to Plot In=w25) -> (Spectrum to Plot Out=w33)
        $"FFT Power Spectrum" <- w33
        call "Signal Power Detection.gvi"(Power Spectrum=w33, threshold=$threshold) -> (Freqs above threshold=w34, indices=w35, count=w36)
        $"Freqs above threshold" <- w34
        $indices <- w35
        $count <- w36
        append w29 to w16
        stop if w32
      }
      next s1 = w16
      stop if w32
    }
    stop if w32
  }
  call "niUSRP Abort.gvi"(session handle=w31, error in=w30) -> (session handle out=w37, error out=w38)
  call "niUSRP Close Session.gvi"(session handle=w37, error in=w38) -> (error out=w39)
  $"error out" <- w39
  $"Samples per Acquisition" <- w6
