vi "Aggregate Sub-band into Spectrum.gvi"   [LabVIEW Communications System Design Software 2.0.1]
inputs:
  "Frame Parameters": T1
  "Power Spectrum Subset": T2
  "Window Properties In": T3
  "Display": T5 = {"display unit"="Vrms", "dB type"="dB"}
  "Reset": bool
  "Iteration": i32
outputs:
  "Window Properties Out": T3
  "Waterfall Plot": f64[][]
  "Spectrum to Plot": cluster{"f0": f64, "df": f64, "IQ": f64[]}
  "Frame Parameters Out": T1
  "Spectrum Size": i32
panel controls:
  "Initialize Spectrum": cluster{"f0": f64, "df": f64, "IQ": f64[]}
types:
  T1 = cluster{"IQ Rate": f64, "Frames": i32, "Length of Subset": i32, "Start Carrier [Hz": f64, "Stop Carrier [Hz]": f64, "Acq Duration [Sec]": f64, "Start Index of Subset": i32}
  T2 = cluster{"f0": f64, "df": f64, "magnitude": f64[]}
  T3 = cluster{"eq noise bw": f64, "coherent gain": f64}
  T4 = enum{"Vrms", "Vpk", "Vrms^2", "Vpk^2", "Vrms/rtHz", "Vpk/rtHz", "Vrms^2/Hz", "Vpk^2/Hz"}
  T5 = cluster{"display unit": T4, "dB type": enum{"Linear", "dB", "dBm"}}
uses:
  NI::Analysis::Measurement::Spectrum Unit Conversion.gvi
diagram:
  Property Node(instance in=$"Frame Parameters") -> ("Frames"=w1, "Length of Subset"=w2, "Start Index of Subset"=w3, instance out=w4)
  Multiply(w1, w2) -> w5
  # Reset is unused
  Is First Call() -> w6
  Logical Or(w6, $Reset) -> w7
  # w3: Start Index
  Property Node(instance in=$"Power Spectrum Subset") -> ("df"=w8, "magnitude"=w9)
  Feedback Node(input=w10) -> w11
  case (w7) {
    frame False, Default {
      w12 = w11
    }
    frame True {
      Initialize Array(element=0, size=w5) -> w13
      # Initialize Spectrum History
      Property Node(instance in=$"Initialize Spectrum", "df"=w8, "IQ"=w13) -> (instance out=w12)
    }
  }
  Multiply($Iteration, w2) -> w14
  Property Node(instance in=$Display) -> ("display unit"=w15, "dB type"=w16)
  # Remove Edges of
  # Sub Spectrum
  Array Subset(array=w9, index0=w3, length0=w2) -> w17
  call "Spectrum Unit Conversion.gvi"(spectrum in=w17, spectrum type="Power (Vrms^2)", dB type=w16, display unit=w15, df=w8, window constants=$"Window Properties In") -> (spectrum out=w18)
  in-place (after w12) {
    Unbundle Bundle Read Poser() -> ("IQ"=w19)
    # Add Current Spectrum to Spectrum History
    Replace Array Subset(inArray=w19, index=w14, new=w18) -> w20
    Unbundle Bundle Write Poser("IQ"=w20)
    w10 = _
  }
  $"Spectrum to Plot" <- w10
  # w2: Length of Subset
  $"Frame Parameters Out" <- w4
  Property Node(instance in=w10) -> ("IQ"=w21)
  Array Size(array=w21)
  Property Node(instance in=w10) -> ("IQ"=w22)
  Array Size(array=w22) -> (size(s)=w23)
  $"Spectrum Size" <- w23
  call "Spectrum History.gvi"(Waterfall Time Scale (s)=10, Magnitude=w22) -> (Waterfall Plot=w24)
  $"Waterfall Plot" <- w24
  $"Window Properties Out" <- $"Window Properties In"
