vi "Array Fill.gvi"   [LabVIEW Communications System Design Software 2.0.1]
inputs:
  "sub_band_ind": i32[]
  "Est. Freqs above Thresh": f64[]
  "Count": i32
outputs:
  "2D(freq,ind)": f64[][]
  "number elements in array": i32
diagram:
  Is Not Equal To 0(x=$Count) -> w1
  case (w1) {
    frame False, Default {
      # If no values signals above threshold,
      # just create an empty queue
      w2 = f64[][] []
    }
    frame True {
      s1 = 0  # shift register
      for {
        w3 = each element of $sub_band_ind
        w4 = each element of $"Est. Freqs above Thresh"
        # w4: top
        Subtract(x=w4, y=s1) -> w5
        Absolute Value(x=w5) -> w6
        # s1: bottom
        Is Greater(x=w6, y=250000) -> w7
        # Top is always feed to bottom. Top and index should always correspond when
        # writing to 2D.
        case (w7) {
          frame False, Default {
            w8 = w4
            w9 = f64[] []
          }
          frame True {
            To Double Precision Float(number=w3) -> w10
            Build Array(w4, w10) -> w9
            w8 = w4
          }
        }
        append w9 to w2 if w7
        next s1 = w8
      }
    }
  }
  # freqs should already be sorted
  $"2D(freq,ind)" <- w2
  Array Size(array=w2) -> (size(s)=w11)
  Array Index(array=w11) -> (out0[_]=w12)
  $"number elements in array" <- w12
