vi "Array Indices for Sub-band.gvi"   [LabVIEW Communications System Design Software 2.0.1]
inputs:
  "First call": bool
  "error in": error
  "2D(freq,ind)": f64[][]
  "niusrp in": "niUSRPClass"
  "IQ frac": f64
outputs:
  "Local Interests": "Local Interests.gtype"
  "error out": error
  "Usrp.niUSRPClass out": "niUSRPClass"
types:
  "Local Interests.gtype" = cluster{"Indices": u32[], "Frequencies": f64[], "Indices in sub-band?": bool}
diagram:
  Array Size(array=$"2D(freq,ind)") -> (size(s)=w1)
  Array Index(array=w1) -> (out0[_]=w2)
  Is Equal To 0(x=w2) -> w3
  Logical Or(w3, $"First call") -> w4
  # w5: Indices of Interest
  # w6: Corresponding Frequencies
  # w7: Indices in sub-band?
  case (w4) {
    frame False, Default {
      Property Node(instance in=$"niusrp in", error in=$"error in") -> ("IQ Rate"=w10, "Carrier Frequency"=w11, error out=w8, instance out=w9)
      Divide(x=$"IQ frac", y=2) -> w12
      Multiply(w10, w12) -> w13
      Round To Nearest(number=w11) -> w14
      Subtract(x=w14, y=w13) -> w15
      Add(w14, w13) -> w16
      s1 = 0  # shift register
      for {
        w17 = each element of $"2D(freq,ind)"
        # Use the fact that the queue is sorted with increasing frequencies.
        # If the first frequency in the queue is not in bounds,
        # then the next freq won't be in bounds either.
        # if (freq >= centerfreq - IQ*frac/2 && freq < centerfreq +IQ*frac/2)
        # w18: Freq
        Array Index(array=w17) -> (out0[_]=w18)
        Is Greater Or Equal(x=w18, y=w15) -> w19
        Is Less Or Equal(x=w18, y=w16) -> w20
        Logical And(w19, w20) -> w21
        case (w21) {
          frame False, Default {
            # This index
            # shouldn't be used
            w22 = 4294967295
            w23 = 0
            w24 = s1
          }
          frame True {
            # This frequency should appear in the current
            # fetch. The index corresponds to this freq in
            # establish sub-band
            Array Index(array=w17) -> (out0[1]=w25)
            To Unsigned Long Integer(number=w25) -> w22
            Increment(x=s1) -> w24
            w23 = w18
          }
        }
        Not(x=w21) -> w26
        append w22 to w5 if w21
        append w23 to w6 if w21
        next s1 = w24
        stop if w26
      }
      Is Not Equal To 0(x=s1) -> w7
    }
    frame True {
      w5 = u32[] []
      w7 = FALSE
      w6 = f64[] []
      w8 = $"error in"
      w9 = $"niusrp in"
    }
  }
  $"Usrp.niUSRPClass out" <- w9
  $"error out" <- w8
  Build Cluster(w5, w6, w7) -> w27
  # ;)
  $"Local Interests" <- w27
