vi "Convert Power Spectrum.gvi"   [LabVIEW Communications System Design Software 2.0.1]
inputs:
  "Display": T2 = {"display unit"="Vrms", "dB type"="dB"}
  "window constants": T4 = {"eq noise BW"=1, "coherent gain"=1}
  "Power Spectrum": T3
outputs:
  "Power Spectrum (converted)": T3
types:
  T1 = enum{"Vrms", "Vpk", "Vrms^2", "Vpk^2", "Vrms/rtHz", "Vpk/rtHz", "Vrms^2/Hz", "Vpk^2/Hz"}
  T2 = cluster{"display unit": T1, "dB type": enum{"Linear", "dB", "dBm"}}
  T3 = cluster{"f0": f64, "df": f64, "magnitude": f64[]}
  T4 = cluster{"eq noise BW": f64, "coherent gain": f64}
uses:
  NI::Analysis::Measurement::Spectrum Unit Conversion.gvi
diagram:
  Property Node(instance in=$"Power Spectrum") -> ("df"=w1, "magnitude"=w2, instance out=w3)
  Property Node(instance in=$Display) -> ("display unit"=w4, "dB type"=w5)
  call "Spectrum Unit Conversion.gvi"(spectrum in=w2, spectrum type="Power (Vrms^2)", dB type=w5, display unit=w4, df=w1, window constants=$"window constants") -> (spectrum out=w6)
  Property Node(instance in=w3, "magnitude"=w6) -> (instance out=w7)
  $"Power Spectrum (converted)" <- w7
