vi "Create Queue.gvi"   [LabVIEW Communications System Design Software 2.0.1]
inputs:
  "sub_band_ind": i32[]
  "Est. Freqs above Thresh": f64[]
outputs:
  "qInd ref": Queue<i32>
  "qFreq ref": Queue<f64>
diagram:
  Array Index(array=$sub_band_ind) -> (out0[0]=w1)
  Array Index(array=$"Est. Freqs above Thresh") -> (out0[0]=w2)
  Obtain Queue(element data type=f64 0, name="qFreq") -> (queue out=w3)
  Obtain Queue(element data type=i32 0, name="qInd") -> (queue out=w4)
  s1 = w1  # shift register
  s2 = w2  # shift register
  for {
    w5 = each element of $sub_band_ind
    w6 = each element of $"Est. Freqs above Thresh"
    Subtract(x=w6, y=s2) -> w7
    Absolute Value(x=w7) -> w8
    Is Greater(x=w8, y=100000) -> w9
    case (w9) {
      frame False, Default {
        w10 = s1
        w11 = s2
        w12 = w3
        w13 = w4
      }
      frame True {
        Enqueue Element(element=s2, queue=w3) -> (queue out=w12)
        Enqueue Element(element=s1, queue=w4) -> (queue out=w13)
        w10 = w5
        w11 = w6
      }
    }
    next s1 = w10
    next s2 = w11
  }
  $"qFreq ref" <- w12
  $"qInd ref" <- w13
