vi "Establish Sub-band.gvi"   [LabVIEW Communications System Design Software 2.0.1]
inputs:
  "Restart Averaging": bool
  "Frame Parameters": T1
  "Averaging Parameters": "Averaging Parameters.gtype" = {"averaging mode"="No averaging", "weighting mode"="Exponential", "number of averages"=10}  # averaging parameters defines how the averaging is computed. The specifications of the parameters include the type of averaging, the type of weighting, and the number of averages.
  "error in": error
  "Input Baseband IQ": c128[]
  "Window Parameters": T2 = {"window type"=0, "window parameter"=NaN}
outputs:
  "Power Spectrum averaged Subset": T5
  "Window Properties": T3
  "error out": error
  "Frame Parameters Out": T1
  "power spectrum current": T6
panel controls:
  "Window Properties Init": T3
types:
  T1 = cluster{"IQ Rate": f64, "Frames": i32, "Length of Subset": i32, "Start Carrier [Hz": f64, "Stop Carrier [Hz]": f64, "Acq Duration [Sec]": f64, "Start Index of Subset": i32}
  "windowTd.gtype" = u32
  T2 = cluster{"window type": "windowTd.gtype", "window parameter": f64}
  T3 = cluster{"eq noise bw": f64, "coherent gain": f64}
  T4 = enum{"No averaging", "Vector averaging", "RMS averaging", "Peak hold"}
  "Averaging Parameters.gtype" = cluster{"averaging mode": T4, "weighting mode": enum{"Linear", "Exponential"}, "number of averages": u32}
  T5 = cluster{"f0": f64, "df": f64, "magnitude": f64[]}
  T6 = cluster{"f0": f64, "df": f64, "spectrum in dB": f64[]}
uses:
  NI::Analysis::Windows::Window Properties by Name.gvi
diagram:
  Property Node(instance in=$"Frame Parameters") -> ("IQ Rate"=w1, instance out=w2)
  $"Frame Parameters Out" <- w2
  Property Node(instance in=$"Window Parameters") -> ("window type"=w3, "window parameter"=w4)
  Reciprocal(x=w1) -> w5
  Build Waveform Node(Y=$"Input Baseband IQ", dt=w5) -> (output waveform=w6)
  call "(Edited) Power Spectrum for 1 Chan (CDB).gvi"(window parameter=w4, restart averaging=$"Restart Averaging", error in=$"error in", averaging parameters=$"Averaging Parameters", window type=w3, signal=w6) -> (error out=w7, power spectrum averaged=w8, power spectrum current=w9)
  $"Power Spectrum averaged Subset" <- w8
  $"power spectrum current" <- w9
  $"error out" <- w7
  Array Size(array=$"Input Baseband IQ") -> (size(s)=w10)
  call "Window Properties by Name.gvi"(size=w10, window type=w3, window parameter=w4) -> (eq noise bw=w11, coherent gain=w12)
  Property Node(instance in=$"Window Properties Init", "eq noise bw"=w11, "coherent gain"=w12) -> (instance out=w13)
  $"Window Properties" <- w13
