vi "Gather Signals for Saving.gvi"   [LabVIEW Communications System Design Software 2.0.1]
inputs:
  "Local Interests": "Local Interests.gtype"
  "power spectrum current": T1
  "Window Properties": T2
  "Display": T4 = {"display unit"="Vrms", "dB type"="dB"}
outputs:
  "Signal Data": "Signal Data.gtype"
  "signals2D": i16[][]
panel indicators:
  "error out": error
types:
  "Local Interests.gtype" = cluster{"Indices": u32[], "Frequencies": f64[], "Indices in sub-band?": bool}
  T1 = cluster{"f0": f64, "df": f64, "spectrum in dB": f64[]}
  T2 = cluster{"eq noise bw": f64, "coherent gain": f64}
  "Signal Data.gtype" = cluster{"fc": f64[], "df": f64, "B": u32, "Trigger Save?": bool}
  T3 = enum{"Vrms", "Vpk", "Vrms^2", "Vpk^2", "Vrms/rtHz", "Vpk/rtHz", "Vrms^2/Hz", "Vpk^2/Hz"}
  T4 = cluster{"display unit": T3, "dB type": enum{"Linear", "dB", "dBm"}}
diagram:
  call "Convert Power Spectrum.gvi"(Display=$Display, window constants=$"Window Properties", Power Spectrum=$"power spectrum current") -> (Power Spectrum (converted)=w1)
  Property Node(instance in=w1) -> ("df"=w2, "magnitude"=w3)
  Property Node(instance in=$"Local Interests") -> ("Indices"=w4, "Frequencies"=w5, "Indices in sub-band?"=w6)
  To Word Integer(number=w3) -> w7
  # Note, signals2D is not the consecutive recordings.
  # There will be #numberavergages of these signals2D
  # by the end of the inner while loop.
  # signals2D:
  # 	Each row is a different signal that peaked above threshold
  # f0:
  # 	Beginning frequency of signal
  # fc:
  # 	value of max peak
  # Trigger Save?:
  # 	Boolean indicating whether to save this data
  # df:
  # 	Common df for the recorded signals
  Math Node("df"=w2, "ind"=w4, "IQ_current"=w7, "freq"=w5, "indices_in_subband"=w6) -> ("signals2D"=w8, "B"=w9, "fc"=w10, Error Out=w11)
  ~~~
  B = uint32(round(500000/df));
  L_ind = length(ind);
  L_IQ = length(IQ_current);
  signals2D = -100*ones(L_ind, 2*B+1);
  fc = zeros(1,L_ind);
  if indices_in_subband
      for ii = 1:L_ind
          if ind(ii) - B < 0 || ind(ii) + B > L_IQ
              %error
          else
              signals2D(ii,:) = IQ_current(ind(ii) - B : ind(ii) + B);
              fc(ii) = freq(ii);
          end
      end
  end
  signals2D = int16(signals2D);
  ~~~
  $"error out" <- w11
  $signals2D <- w8
  Build Cluster(w10, w2, w9, w6) -> w12
  $"Signal Data" <- w12
