vi "Plot Spectrum.gvi"   [LabVIEW Communications System Design Software 2.0.1]
inputs:
  "Frame Parameters": T1
  "Spectrum to Plot In": cluster{"f0": f64, "df": f64, "IQ": f64[]}
outputs:
  "Spectrum to Plot Out": cluster{"f0": f64, "df": f64, "IQ": f64[]}
  "Frame Parameters out": T1
panel controls:
  "Spectrum to Plot Initialize": cluster{"f0": f64, "df": f64, "IQ": f64[]}
types:
  T1 = cluster{"IQ Rate": f64, "Frames": i32, "Length of Subset": i32, "Start Carrier [Hz": f64, "Stop Carrier [Hz]": f64, "Acq Duration [Sec]": f64, "Start Index of Subset": i32}
diagram:
  Property Node(instance in=$"Frame Parameters") -> ("Start Carrier [Hz"=w1, "Length of Subset"=w2, instance out=w3)
  $"Frame Parameters out" <- w3
  # f0 was not being calculated correctly. FIXED
  Property Node(instance in=$"Spectrum to Plot In") -> ("df"=w4, "IQ"=w5)
  Multiply(w2, 0.5) -> w6
  Multiply(w6, w4) -> w7
  Subtract(x=w1, y=w7) -> w8
  Property Node(instance in=$"Spectrum to Plot Initialize", "f0"=w8, "df"=w4, "IQ"=w5) -> (instance out=w9)
  $"Spectrum to Plot Out" <- w9
