vi "Put in Spectrum.gvi"   [LabVIEW Communications System Design Software 2.0.1]
inputs:
  "df": f64
  "data": f64[]
  "f0": f64
  "max freq": f64
  "Reset": bool
  "min freq": f64
outputs:
  "Spectrum to Plot": cluster{"f0": f64, "df": f64, "IQ": f64[]}
panel controls:
  "Initialize Spectrum": cluster{"f0": f64, "df": f64, "IQ": f64[]}
diagram:
  Subtract(x=$f0, y=$"min freq") -> w1
  Quotient And Remainder(x=w1, y=$df) -> (floor(x/y)=w2)
  To Unsigned Long Integer(number=w2) -> w3
  Subtract(x=$"max freq", y=$"min freq") -> w4
  Quotient And Remainder(x=w4, y=$df) -> (floor(x/y)=w5)
  Is First Call() -> w6
  Logical Or(w6, $Reset) -> w7
  Feedback Node(input=w8) -> w9
  case (w7) {
    frame False, Default {
      w10 = w9
    }
    frame True {
      Initialize Array(element=-130, size=w5) -> w11
      # Initialize Spectrum History
      Property Node(instance in=$"Initialize Spectrum", "f0"=$"min freq", "df"=$df, "IQ"=w11) -> (instance out=w10)
    }
  }
  in-place (after w10) {
    Unbundle Bundle Read Poser() -> ("IQ"=w12)
    # Add Current Spectrum to Spectrum History
    Replace Array Subset(inArray=w12, index=w3, new=$data) -> w13
    Unbundle Bundle Write Poser("IQ"=w13)
    w8 = _
  }
  $"Spectrum to Plot" <- w8
