vi "Queue Fill.gvi"   [LabVIEW Communications System Design Software 2.0.1]
inputs:
  "sub_band_ind": i32[]
  "Est. Freqs above Thresh": f64[]
  "Queue Name": string = "q(Freq,Ind)"
  "Count": i32
outputs:
  "queueRefOut(Freq,Ind)": Queue<f64[]>
  "error out": error
  "number elements in queue": i32
diagram:
  Is Not Equal To 0(x=$Count) -> w1
  Obtain Queue(element data type=f64[] [], name=$"Queue Name") -> (error out=w2, queue out=w3)
  Flush Queue(error in=w2, queue=w3) -> (error out=w4, queue out=w5)
  # String name should be used throughout.
  # Maybe make it a constant on spectrum monitor diagram and wire manually
  case (w1) {
    frame False, Default {
      # If no values signals above threshold,
      # just create an empty queue
      w6 = w5
      w7 = w4
    }
    frame True {
      s1 = 0  # shift register
      for {
        w8 = each element of $sub_band_ind
        w9 = each element of $"Est. Freqs above Thresh"
        Subtract(x=w9, y=s1) -> w10
        Absolute Value(x=w10) -> w11
        Is Greater(x=w11, y=100000) -> w12
        case (w12) {
          frame False, Default {
            w13 = s1
            w6 = w5
            w7 = w4
          }
          frame True {
            To Double Precision Float(number=w8) -> w14
            Build Array(w9, w14) -> w15
            Enqueue Element(element=w15, error in=w4, queue=w5) -> (error out=w7, queue out=w6)
            w13 = w9
          }
        }
        next s1 = w13
      }
    }
  }
  Get Queue Status(error in=w7, queue=w6) -> (# elements in queue=w16, error out=w17, queue out=w18)
  $"queueRefOut(Freq,Ind)" <- w18
  $"error out" <- w17
  $"number elements in queue" <- w16
