vi "Queue Indices for Sub-band.gvi"   [LabVIEW Communications System Design Software 2.0.1]
inputs:
  "First call": bool
  "Queue Name": string
  "niusrp in": "niUSRPClass"
  "error in": error
  "IQ frac": f64
outputs:
  "Local Interests": "Local Interests.gtype"
  "error out": error
  "Usrp.niUSRPClass out": "niUSRPClass"
panel indicators:
  "timed out?": bool
  "elements": cluster{"Element 0": f64[]}[]
types:
  "Local Interests.gtype" = cluster{"Indices": u32[], "Frequencies": f64[], "Indices in sub-band?": bool}
diagram:
  Obtain Queue(element data type=f64[] [], error in=$"error in", name=$"Queue Name") -> (error out=w1, queue out=w2)
  Get Queue Status(error in=w1, queue=w2, return elements?=TRUE) -> (# elements in queue=w3, elements=w4, error out=w5, queue out=w6)
  Is Equal To 0(x=w3) -> w7
  Logical Or(w7, $"First call") -> w8
  case (w8) {
    frame False, Default {
      while {
        # w14: q(Freq,Ind)
        Preview Queue Element(error in=w5, queue=w6, timeout in ms=100) -> (element=w14, error out=w15, queue out=w16, timed out?=w17)
        # Use the fact that the queue is sorted with increasing frequencies.
        # If the first frequency in the queue is not in bounds,
        # then the next freq won't be in bounds either.
        # if (freq >= centerfreq - IQ*frac/2 && freq < centerfreq +IQ*frac/2)
        $"timed out?" <- w17
        # w18: Freq
        Array Index(array=w14) -> (out0[_]=w18)
        Property Node(instance in=$"niusrp in") -> ("IQ Rate"=w19, "Carrier Frequency"=w20, instance out=w9)
        Round To Nearest(number=w20) -> w21
        Divide(x=w19, y=2) -> w22
        Multiply(w22, $"IQ frac") -> w23
        Subtract(x=w21, y=w23) -> w24
        Is Greater Or Equal(x=w18, y=w24) -> w25
        Add(w21, w23) -> w26
        Is Less Or Equal(x=w18, y=w26) -> w27
        Logical And(w25, w27) -> w28
        case (w28) {
          frame False, Default {
            # This index
            # shouldn't be used
            w29 = 4294967295
            w30 = w15
            w31 = w16
            w32 = 0
          }
          frame True {
            Dequeue Element(error in=w15, queue=w16) -> (element=w33, error out=w30, queue out=w31)
            # Ind
            Array Index(array=w33) -> (out0[1]=w34)
            To Unsigned Long Integer(number=w34) -> w29
            # remove from queue. This freq should
            # appear in current fetch. Ind corresponds
            # to this freq in establish sub-band
            Array Index(array=w33) -> (out0[_]=w32)
          }
        }
        Not(x=w28) -> w35
        append w29 to w11 if w28
        append w32 to w13 if w28
        stop if w35
      }
      Get Queue Status(error in=w30, queue=w31) -> (# elements in queue=w36, error out=w10)
      Is Not Equal(x=w36, y=w3) -> w12
    }
    frame True {
      w9 = $"niusrp in"
      w10 = w5
      w11 = u32[] []
      w12 = FALSE
      w13 = f64[] []
    }
  }
  $"Usrp.niUSRPClass out" <- w9
  # w11: Indices of Interest
  $"error out" <- w10
  # w13: Corresponding Frequencies
  Build Cluster(w11, w13, w12) -> w37
  # ;)
  $"Local Interests" <- w37
  $elements <- w4
