vi "Read Data.gvi"   [LabVIEW Communications System Design Software 2.0.1]
inputs:
  "USRP Session Handle In": "niUSRPClass"
  "error in": error
  "Number of Samples": i64
outputs:
  "USRP Session Handle Out": "niUSRPClass"
  "error out": error
  "data": c128[]
panel indicators:
  "error cleared?": bool  # specific error cleared? indicates whether the error referenced by specific error code to clear has been cleared.
diagram:
  call "niUSRP Initiate.gvi"(session handle=$"USRP Session Handle In", error in (no error)=$"error in") -> (session handle out=w1, Error Out=w2)
  call "Filter Error Code.gvi"(code to clear=-1074118626, error in=w2) -> (error cleared?=w3, error out=w4)
  call "niUSRP Fetch Rx Data (CDB).gvi"(session handle=w1, number of samples=$"Number of Samples", timeout=1, error in (no error)=w4) -> (session handle out=w5, data=w6, Error Out=w7)
  $"USRP Session Handle Out" <- w5
  $"error out" <- w7
  $"error cleared?" <- w3
  $data <- w6
