vi "Read From File ALT.gvi"   [LabVIEW Communications System Design Software 2.0.1]
inputs:
  "file path": path
  "Min Freq": f64 = 80000000
outputs:
  "FFT Power Spectrum": cluster{"f0": f64, "df": f64, "IQ": f64[]}
  "timestamp": timestamp
panel controls:
  "Type: Waveform": waveform<f64> = {dt=0.1, Y=[]}
  "Type: Numeric Array": f64[]
  "Display History?": bool
  "Pause": bool
  "Playback Speed": f64
  "Number of Samples": f64
panel indicators:
  "iterations": i64
diagram:
  w1 = $"Type: Numeric Array"
  Strip Path(path=$"file path") -> (name=w2, stripped path=w3)
  Concatenate Strings("helper_", w2) -> w4
  Build Path(base path=w3, name or relative path=w4) -> (appended path=w5)
  TDMS Open(file path=w5, operation="open (read-only)") -> (tdms file out=w6)
  TDMS Read(data type=w1, group name in="B,df", tdms file=w6) -> (data=w7, tdms file out=w8)
  Array Index(array=w7) -> (out0[_]=w9)
  To Quad Integer(number=w9) -> w10
  Array Index(array=w7) -> (out0[1]=w11)
  # w10: B
  Multiply(w10, 2) -> w12
  Increment(x=w12) -> w13
  TDMS Open(file path=$"file path", operation="open (read-only)") -> (tdms file out=w14)
  w15 = $"Number of Samples"
  # w11: df
  s1 = 0  # shift register
  s2 = 0  # shift register
  while {
    TDMS Read(count=20, data type=w1, group name in="tod,len,fc", offset=s2, tdms file=w8) -> (data=w16, end of file?=w17, tdms file out=w18)
    # w19: len
    Array Index(array=w16) -> (out0[1]=w19)
    To Long Integer(number=w19) -> w20
    Add(s2, w20) -> w21
    Add(2, w21) -> w22
    Multiply($"Playback Speed", 20) -> w23
    Increment(x=w23) -> w24
    Wait(time to wait=w24)
    # w25: fc
    Array Subset(array=w16, index0=2, length0=w19) -> w25
    # w26: B*df
    Multiply(w10, w11) -> w26
    # w27: f0
    Subtract(x=w25, y=w26) -> w27
    s3 = s1  # shift register
    for (N = w20) (iteration -> i1) {
      w28 = each element of w27
      Increment(x=s3) -> w29
      Multiply(s3, w13) -> w30
      TDMS Read(count=w13, data type=$"Type: Waveform", group name in="Untitled", offset=w30, return channels in file order=TRUE, tdms file=w14) -> (data=w31, tdms file out=w32)
      Property Node(instance in=w31) -> ("Y"=w33)
      Is Equal To 0(x=i1) -> w34
      Not(x=$"Display History?") -> w35
      Logical And(w35, w34) -> w36
      call "Put in Spectrum.gvi"(df=w11, data=w33, f0=w28, Number of Samples=w15, Reset=w36, min freq=$"Min Freq") -> (Spectrum to Plot=w37)
      next s3 = w29
    }
    $iterations <- s3
    $"FFT Power Spectrum" <- w37
    while {
      Wait(time to wait=50)
      Not(x=$Pause) -> w38
      stop if w38
    }
    # w39: tod
    Array Index(array=w16) -> (out0[0]=w39)
    To Time Stamp(number=w39) -> w40
    $timestamp <- w40
    next s1 = s3
    next s2 = w22
    stop if w17
  }
  TDMS Close(tdms file=w32)
  TDMS Close(tdms file=w18)
