vi "Read From File.gvi"   [LabVIEW Communications System Design Software 2.0.1]
inputs:
  "B": i32
  "file path": path
outputs:
  "FFT Power Spectrum": cluster{"f0": f64, "df": f64, "IQ": f64[]}
panel controls:
  "FFT Initialize": cluster{"f0": f64, "df": f64, "IQ": f64[]}
panel indicators:
  "loop iteration": i32
  "group/channel names": string[][]
  "property values": variant[]
  "property names": string[]
  "group names": string[]
diagram:
  TDMS Open(file path=$"file path", operation="open (read-only)") -> (tdms file out=w1)
  Multiply($B, 2) -> w2
  Increment(x=w2) -> w3
  while (iteration -> i1) {
    TDMS Get Properties(tdms file=w1) -> (property names=w4, property values=w5)
    $"property values" <- w5
    $"property names" <- w4
    TDMS List Contents(tdms file=w1) -> (group names=w6, group/channel names=w7)
    $"group names" <- w6
    $"group/channel names" <- w7
    Wait(time to wait=200)
    Multiply(w3, i1) -> w8
    To Quad Integer(number=w3) -> w9
    TDMS Read(count=w9, offset=w8, return channels in file order=TRUE, tdms file=w1) -> (data=w10, end of file?=w11, tdms file out=w12)
    Array Size(array=w10) -> (size(s)=w13)
    for (N = w13) {
      w14 = each element of w10
      Property Node(instance in=w14) -> ("Y"=w15, "t0"=w16, "dt"=w17)
      To Double Precision Float(number=w16) -> w18
      Property Node(instance in=$"FFT Initialize", "f0"=w18, "df"=w17, "IQ"=w15) -> (instance out=w19)
    }
    $"FFT Power Spectrum" <- w19
    $"loop iteration" <- i1
    stop if w11
  }
  TDMS Close(tdms file=w12)
