vi "Save Data to File ALT.gvi"   [LabVIEW Communications System Design Software 2.0.1]
inputs:
  "Signal Data Array": "Signal Data.gtype"[]
  "file path": path
  "Timestamp Array": timestamp[]
  "Signal 4D": i16[][][][]
types:
  "Signal Data.gtype" = cluster{"fc": f64[], "df": f64, "B": u32, "Trigger Save?": bool}
diagram:
  Is First Call() -> w1
  # signals3D:
  # 	The added third dimension corresponds to a time of recording,
  # 	the nth iteration of the averaging loop.
  # 	Each row is a different signal that peaked above threshold
  # f0:
  # 	Beginning frequency of signal.
  # Trigger Save?:
  # 	Boolean indicating whether to save this data
  # df:
  # 	Common df for the recorded signals
  # I believe auto index tunnels require consistent dimension size.
  # Sometimes another row of zeros is added to
  # keep dimensions consistent in the main diagram.
  # We don't want to save these guys.
  for {
    w2 = each element of $"Signal 4D"
    w3 = each element of $"Signal Data Array"
    w4 = each element of $"Timestamp Array"
    Property Node(instance in=w3) -> ("df"=w5, "Trigger Save?"=w6, "B"=w7, "fc"=w8)
    # w2: Signal 3D
    case (w1) {
      frame False, Default {
        TDMS Open(file path=$"file path", operation="open") -> (tdms file out=w9)
        Strip Path(path=$"file path") -> (name=w11, stripped path=w12)
        Concatenate Strings("helper_", w11) -> w13
        Build Path(base path=w12, name or relative path=w13) -> (appended path=w14)
        TDMS Open(file path=w14, operation="open") -> (tdms file out=w10)
      }
      frame True {
        TDMS Open(file path=$"file path", operation="create or replace") -> (tdms file out=w9)
        Build Array(w7, w5) -> w15
        Strip Path(path=$"file path") -> (name=w16, stripped path=w17)
        Concatenate Strings("helper_", w16) -> w18
        Build Path(base path=w17, name or relative path=w18) -> (appended path=w19)
        TDMS Open(file path=w19, operation="create or replace") -> (tdms file out=w20)
        TDMS Write(data=w15, group name in="B,df", tdms file=w20) -> (tdms file out=w10)
      }
    }
    case (w6) {
      frame False, Default {
        w21 = w9
        w22 = w10
      }
      frame True {
        for {
          w23 = each element of w2
          for {
            w24 = each element of w23
            Array Index(array=w24) -> (out0[_]=w25)
            Is Equal To 0(x=w25) -> w26
            case (w26) {
              frame True {
                w21 = w9
              }
              frame False {
                Build Waveform Node(Y=w24, dt=w5, t0=w4) -> (output waveform=w27)
                TDMS Write(data=w27, tdms file=w9) -> (tdms file out=w21)
              }
            }
          }
        }
        To Double Precision Float(number=w4) -> w28
        Array Size(array=w8) -> (size(s)=w29)
        Build Array[ConcatenateInputs=True](w28, w29, w8) -> w30
        TDMS Write(data=w30, group name in="tod,len,fc", tdms file=w10) -> (tdms file out=w22)
      }
    }
  }
  TDMS Close(tdms file=w21)
  TDMS Close(tdms file=w22)
