vi "Save Data to File.gvi"   [LabVIEW Communications System Design Software 2.0.1]
inputs:
  "file path": path
  "signals2D": f64[][]
  "df": f64
  "f0": f64[]
  "Trigger Save?": bool
diagram:
  Array Size(array=$signals2D) -> (size(s)=w1)
  Array Index(array=w1) -> (out0[1]=w2)
  case ($"Trigger Save?") {
    frame False, Default { }
    frame True {
      Is First Call() -> w3
      case (w3) {
        frame False, Default {
          TDMS Open(file path=$"file path", operation="open") -> (tdms file out=w4)
        }
        frame True {
          TDMS Open(disable buffering=TRUE, file path=$"file path", operation="create or replace") -> (tdms file out=w4)
        }
      }
      for (N = w2) {
        w5 = each element of $f0
        w6 = each element of $signals2D
        To Time Stamp(number=w5) -> w7
        Build Waveform Node(Y=w6, dt=$df, t0=w7) -> (output waveform=w8)
        TDMS Write(data=w8, tdms file=w4) -> (tdms file out=w9)
      }
      TDMS Close(tdms file=w9)
    }
  }
