vi "Set Carrier and LO_2.gvi"   [LabVIEW Communications System Design Software 2.0.1]
inputs:
  "Current Frequency": f64
  "niusrp in_2": "niUSRPClass"
  "error in": error
outputs:
  "Error": error
  "Usrp.niUSRPClass": "niUSRPClass"
diagram:
  Add($"Current Frequency", 10000000) -> w1
  # In this version, the local oscillator is always updated
  # and pushed ahead of the carrier frequency so that
  # we never see local oscillator leakage in the spectrum
  # after the edges are clipped
  Property Node(instance in=$"niusrp in_2", "Carrier Frequency"=$"Current Frequency", "LO Frequency"=w1, error in=$"error in") -> (error out=w2, instance out=w3)
  $"Usrp.niUSRPClass" <- w3
  $Error <- w2
