vi "Set Parameters.gvi"   [LabVIEW Communications System Design Software 2.0.1]
inputs:
  "RX Parameters In": T1
  "USRP Session Handle In": "niUSRPClass"
  "error in (no error)": error
  "IQ frac": enum{"0.25", "0.5", "0.6", "0.8"} = "0.25"
outputs:
  "error out: HW RX Param subsetup": error
  "USRP Session Handle Out": "niUSRPClass"
  "Test Carrier Frequencies": f64[]
  "Samples per Acquisition": i64
  "Frame Parameters Out": T2
  "IQ frac out": f64
types:
  T1 = cluster{"IQ Sampling Rate [S/sec]": f64, "Gain [dB]": f64, "Reference Frequency": string, "Timebase Clock Source": string, "Start Carrier [Hz]": f64, "Stop Carrier [Hz]": f64, "Acq Duration [sec]": f64, "Active Antenna": string}
  T2 = cluster{"IQ Rate": f64, "Frames": i32, "Length of Subset": i32, "Start Carrier [Hz": f64, "Stop Carrier [Hz]": f64, "Acq Duration [Sec]": f64, "Start Index of Subset": i32}
diagram:
  case ($"IQ frac") {
    frame "0.25", Default {
      w1 = 24
      w2 = 0.25
    }
    frame "0.6" {
      w1 = 30
      w2 = 0.6
    }
    frame "0.5" {
      w1 = 4
      w2 = 0.5
    }
    frame "0.8" {
      w1 = 20
      w2 = 0.8
    }
  }
  $"IQ frac out" <- w2
  # Initialize USRP properties for reading
  call "Write Rx Properties.gvi"(RX Parameters In=$"RX Parameters In", USRP Session Handle In=$"USRP Session Handle In", error in (no error)=$"error in (no error)") -> (RX Parameters Out=w3, USRP Session Handle Out=w4, error out=w5)
  call "Find Carriers, Set Frame.gvi"(RX Parameters In=w3, LCM=w1, IQ frac=w2) -> (Frame Parameters Out=w6, Samples per Acquisition=w7, Test Carrier Frequencies=w8)
  # Determine frame configurations
  # and carrier frequencies
  $"Frame Parameters Out" <- w6
  $"Samples per Acquisition" <- w7
  $"Test Carrier Frequencies" <- w8
  $"USRP Session Handle Out" <- w4
  $"error out: HW RX Param subsetup" <- w5
