vi "Signal Power Detection.gvi"   [LabVIEW Communications System Design Software 2.0.1]
inputs:
  "Power Spectrum": cluster{"f0": f64, "df": f64, "IQ": f64[]}
  "threshold": f64
outputs:
  "Power at those Freqs.": f64[]
  "Est. Freqs above Thresh": f64[]
  "count": i32
uses:
  NI::Analysis::Measurement::Threshold Detector.gvi
diagram:
  Property Node(instance in=$"Power Spectrum") -> ("f0"=w1, "df"=w2, "IQ"=w3)
  # Adjust parameter for signal width
  # desired above threshold.
  # w4: indices
  call "Threshold Detector.gvi"(signal=w3, threshold=$threshold, width=3) -> (indices=w4, count=w5)
  Increment(x=3) -> w6
  # w2: note, df = sample rate / samples
  Array Size(array=w4) -> (size(s)=w7)
  # Returns first index of a peak above threshold,
  # but doesn't return the index of max in the group.
  for (N = w7) {
    w8 = each element of w4
    Array Subset(array=w3, index0=w8, length0=w6) -> w11
    Array Max And Min(array=w11) -> (max index(es)=w12)
    Add(w12, w8) -> w13
    Array Index(array=w3) -> (out0[w13]=w14)
    append w14 to w9
    append w13 to w10
  }
  Multiply(w2, w10) -> w15
  Add(w1, w15) -> w16
  $"Est. Freqs above Thresh" <- w16
  $"Power at those Freqs." <- w9
  $count <- w5
