vi "Signal Power Detection_2.gvi"   [LabVIEW Communications System Design Software 2.0.1]
inputs:
  "Power Spectrum": cluster{"f0": f64, "df": f64, "IQ": f64[]}
  "threshold": f64
  "Frame Parameters Out": T1
outputs:
  "Power at those Freqs.": f64[]
  "Est. Freqs above Thresh": f64[]
  "count": i32
  "sub_band_ind": i32[]
types:
  T1 = cluster{"IQ Rate": f64, "Frames": i32, "Length of Subset": i32, "Start Carrier [Hz": f64, "Stop Carrier [Hz]": f64, "Acq Duration [Sec]": f64, "Start Index of Subset": i32}
uses:
  NI::Analysis::Measurement::Threshold Detector.gvi
diagram:
  Property Node(instance in=$"Power Spectrum") -> ("f0"=w1, "df"=w2, "IQ"=w3)
  # w4: indices
  # Returns first index of a peak above threshold,
  # but doesn't return the index of max in the group.
  # Adjust parameter for signal width
  # desired above threshold.
  call "Threshold Detector.gvi"(signal=w3, threshold=$threshold, width=1) -> (indices=w4, count=w5)
  Array Size(array=w4) -> (size(s)=w6)
  Array Size(array=w3) -> (size(s)=w7)
  Replace Array Subset(inArray=w4, index=_, new=w7) -> w8
  # last ind(i++)
  # = end ind of iq
  Rotate 1D Array(array=w8, n=-1) -> (array (last n elements first)=w9)
  for (N = w6) {
    w10 = each element of w4
    w11 = each element of w9
    # Finding peak above threshold
    # w10: ind(i)
    # w11: ind(i++)
    Subtract(x=w11, y=w10) -> w14
    Array Subset(array=w3, index0=w10, length0=w14) -> w15
    Array Max And Min(array=w15) -> (max index(es)=w16)
    Add(w16, w10) -> w17
    Array Index(array=w3) -> (out0[w17]=w18)
    append w18 to w12
    append w17 to w13
  }
  Multiply(w2, w13) -> w19
  Add(w1, w19) -> w20
  $"Est. Freqs above Thresh" <- w20
  # w2: note, df = sample rate / samples
  Property Node(instance in=$"Frame Parameters Out") -> ("Length of Subset"=w21, "Start Index of Subset"=w22)
  Quotient And Remainder(x=w13, y=w21) -> (x-y*floor(x/y)=w23)
  Add(w23, w22) -> w24
  $sub_band_ind <- w24
  $"Power at those Freqs." <- w12
  $count <- w5
