vi "Spectrum History.gvi"   [LabVIEW Communications System Design Software 2.0.1]
inputs:
  "Waterfall Time Scale (s)": i32 = 5
  "Magnitude": f64[]
outputs:
  "Waterfall Plot": f64[][]
diagram:
  Array Size(array=$Magnitude) -> (size(s)=w1)
  # w1: Number of Samples
  Multiply(10, $"Waterfall Time Scale (s)") -> w2
  Is First Call() -> w3
  case (w3) {
    frame False, Default {
      w4 = default
    }
    frame True {
      Initialize Array(element=-120, size=w1, size=w2) -> w4
    }
  }
  Feedback Node(initial value=w4, input=w5) -> w6
  Insert Into Array(inArray=w6, index1=0, new=$Magnitude) -> w7
  Delete From Array(inArray=w7, length (1)=w1, index1=w2) -> w5
  $"Waterfall Plot" <- w5
