vi "Spectrum Monitor (no saving).gvi"   [LabVIEW Communications System Design Software 2.0.1]
outputs:
  "LO Frequency": f64
  "Spectrum Size": i32
  "Frame Parameters Out": T5
panel controls:
  "RX Parameters In": T1 = {"IQ Sampling Rate [S/sec]"=20000000, "Gain [dB]"=0, "Reference Frequency"="Internal", "Timebase Clock Source"="Internal", "Start Carrier [Hz]"=75000000, "Stop Carrier [Hz]"=125000000, "Acq Duration [sec]"=0.0001, "Active Antenna"="RX2"}
  "Device Names": "niUSRPClass" = "192.168.10.2"
  "Averaging Parameters": "Averaging Parameters.gtype" = {"averaging mode"="RMS averaging", "weighting mode"="Linear", "number of averages"=4}  # averaging parameters defines how the averaging is computed. The specifications of the parameters include the type of averaging, the type of weighting, and the number of averages.
  "Display": T4 = {"display unit"="Vrms", "dB type"="dB"}
  "Stop Capture": bool
  "Tab": i32
  "threshold": f64 = -60
  "IQ frac": enum{"0.25", "0.5", "0.6", "0.8"} = "0.25"
  "Waterfall History Length": i32 = 1
  "Compress Frequency Bins?": bool
panel indicators:
  "error out": error
  "Samples per Acquisition": i64
  "Carrier Freq Out": f64
  "FFT Power Spectrum": cluster{"f0": f64, "df": f64, "IQ": f64[]}
  "Carrier List": f64[]
  "Power Detection": "Power Detection cluster.gtype"
  "Waterfall Plot": f64[][]
  "current refresh (ms)": u32
  "average period (ms)": f64
types:
  T1 = cluster{"IQ Sampling Rate [S/sec]": f64, "Gain [dB]": f64, "Reference Frequency": string, "Timebase Clock Source": string, "Start Carrier [Hz]": f64, "Stop Carrier [Hz]": f64, "Acq Duration [sec]": f64, "Active Antenna": string}
  T2 = enum{"No averaging", "Vector averaging", "RMS averaging", "Peak hold"}
  "Averaging Parameters.gtype" = cluster{"averaging mode": T2, "weighting mode": enum{"Linear", "Exponential"}, "number of averages": u32}
  T3 = enum{"Vrms", "Vpk", "Vrms^2", "Vpk^2", "Vrms/rtHz", "Vpk/rtHz", "Vrms^2/Hz", "Vpk^2/Hz"}
  T4 = cluster{"display unit": T3, "dB type": enum{"Linear", "dB", "dBm"}}
  T5 = cluster{"IQ Rate": f64, "Frames": i32, "Length of Subset": i32, "Start Carrier [Hz": f64, "Stop Carrier [Hz]": f64, "Acq Duration [Sec]": f64, "Start Index of Subset": i32}
  "Power Detection cluster.gtype" = cluster{"Estimated Freqs. above Threshold": f64[], "Power at those Freqs.": f64[], "Num. peaks detected": i32, "Num. in queue": i32}
diagram:
  call "niUSRP Open Rx Session.gvi"(niUSRP Device=$"Device Names") -> (error out=w1, session handle out=w2)
  call "Set Parameters.gvi"(RX Parameters In=$"RX Parameters In", USRP Session Handle In=w2, error in (no error)=w1, IQ frac=$"IQ frac") -> (error out: HW RX Param subsetup=w3, USRP Session Handle Out=w4, Test Carrier Frequencies=w5, Samples per Acquisition=w6, Frame Parameters Out=w7, IQ frac out=w8)
  call "niUSRP Configure Number of Samples.gvi"(session handle=w4, number of samples is finite=TRUE, number of samples=w6, error in (no error)=w3) -> (session handle out=w9, Error Out=w10)
  w11 = $"Waterfall History Length"
  w12 = $"Compress Frequency Bins?"
  Tick Count() -> (timer value=w13)
  # Testing Spectrum Monitor. Not as many indicators will
  # be on panel in final version.
  while (iteration -> i1) {
    w15 = $"Averaging Parameters"
    w16 = $Display
    # Go back to the first carrier frequency and repeat
    s1 = 0  # shift register
    for (iteration -> i2) (after w8) {
      w17 = each element of w5
      call "Set Carrier and LO_2.gvi"(Current Frequency=w17, niusrp in_2=w9, error in=w10) -> (Error=w18, Usrp.niUSRPClass=w19)
      # Get new carrier frequency
      Property Node(instance in=w15) -> ("number of averages"=w20, instance out=w21)
      To Long Integer(number=w20) -> w22
      for (N = w22) (iteration -> i3) {
        # Averaging Loop
        call "Read Data.gvi"(USRP Session Handle In=w19, error in=w18, Number of Samples=w6) -> (USRP Session Handle Out=w24, error out=w25, data=w26)
        Is Equal To 0(x=i3) -> w27
        call "Establish Sub-band.gvi"(Restart Averaging=w27, Frame Parameters=w7, Averaging Parameters=w21, error in=w25, Input Baseband IQ=w26) -> (Power Spectrum averaged Subset=w28, Window Properties=w29, error out=w30, Frame Parameters Out=w31)
        # w27: First Rx for this carrier?
        Logical Or(w30, $"Stop Capture") -> w32
        append w30 to w23
        stop if w32
      }
      Merge Errors(w23) -> (error out=w33)
      Property Node(instance in=w24, error in=w33) -> ("Carrier Frequency"=w34, "LO Frequency"=w35, error out=w36, instance out=w37)
      $"Carrier Freq Out" <- w34
      $"LO Frequency" <- w35
      call "Aggregate Sub-band into Spectrum.gvi"(Frame Parameters=w31, Power Spectrum Subset=w28, Window Properties In=w29, Display=w16, Iteration=i2) -> (Spectrum to Plot=w38, Frame Parameters Out=w39, Spectrum Size=w40)
      call "Plot Spectrum.gvi"(Frame Parameters=w39, Spectrum to Plot In=w38) -> (Spectrum to Plot Out=w41, Frame Parameters out=w42)
      $"FFT Power Spectrum" <- w41
      $"Spectrum Size" <- w40
      next s1 = w35
      stop if w32
    }
    call "Signal Power Detection_2.gvi"(Power Spectrum=w41, threshold=$threshold, Frame Parameters Out=w42) -> (Power at those Freqs.=w43, Est. Freqs above Thresh=w44, count=w45, sub_band_ind=w46)
    call "Array Fill.gvi"(sub_band_ind=w46, Est. Freqs above Thresh=w44, Count=w45) -> (number elements in array=w47)
    Build Cluster(w44, w43, w45, w47) -> w48
    $"Power Detection" <- w48
    call "Waterfal Plot Generator.gvi"(Compress?=w12, FFT Power Spectrum=w41, Waterfall History Length=w11) -> (Waterfall Plot=w49)
    $"Waterfall Plot" <- w49
    Tick Count() -> (timer value=w50)
    Feedback Node(initial value=w13, input=w50) -> w51
    Subtract(x=w50, y=w51) -> w52
    To Double Precision Float(number=w52) -> w53
    $"current refresh (ms)" <- w52
    append w53 to w14
    stop if w32
  }
  call "niUSRP Abort.gvi"(Handle in=w37, error in (no error)=w36) -> (Handle out=w54, Error Out=w55)
  call "niUSRP Close Session.gvi"(handle in=w54, error in=w55) -> (error out=w56)
  $"error out" <- w56
  Add Array Elements(numeric array=w14) -> (sum=w57: f64)
  Divide(x=w57, y=i1) -> w58
  $"average period (ms)" <- w58
  $"Carrier List" <- w5
  $"Samples per Acquisition" <- w6
  $"Frame Parameters Out" <- w7
