vi "Spectrum Monitor (queues).gvi"   [LabVIEW Communications System Design Software 2.0.1]
outputs:
  "LO Frequency": f64
  "Spectrum Size": i32
  "Frame Parameters Out": T5
panel controls:
  "RX Parameters In": T1 = {"IQ Sampling Rate [S/sec]"=20000000, "Gain [dB]"=0, "Reference Frequency"="", "Timebase Clock Source"="", "Start Carrier [Hz]"=50000000, "Stop Carrier [Hz]"=500000000, "Acq Duration [sec]"=0.0001, "Active Antenna"=""}
  "Device Names": "niUSRPClass"
  "Averaging Parameters": "Averaging Parameters.gtype" = {"averaging mode"="No averaging", "weighting mode"="Exponential", "number of averages"=10}  # averaging parameters defines how the averaging is computed. The specifications of the parameters include the type of averaging, the type of weighting, and the number of averages.
  "Display": T4 = {"display unit"="Vrms", "dB type"="dB"}
  "Stop Capture": bool
  "Tab": i32
  "threshold": f64
  "IQ frac": enum{"0.25", "0.5", "0.6", "0.8"} = "0.25"
  "Queue Name": string = "q(Freq,Ind)"
panel indicators:
  "error out": error
  "Samples per Acquisition": i64
  "Carrier Freq Out": f64
  "FFT Power Spectrum": cluster{"f0": f64, "df": f64, "IQ": f64[]}
  "Carrier List": f64[]
  "Power Detection": "Power Detection cluster.gtype"
types:
  T1 = cluster{"IQ Sampling Rate [S/sec]": f64, "Gain [dB]": f64, "Reference Frequency": string, "Timebase Clock Source": string, "Start Carrier [Hz]": f64, "Stop Carrier [Hz]": f64, "Acq Duration [sec]": f64, "Active Antenna": string}
  T2 = enum{"No averaging", "Vector averaging", "RMS averaging", "Peak hold"}
  "Averaging Parameters.gtype" = cluster{"averaging mode": T2, "weighting mode": enum{"Linear", "Exponential"}, "number of averages": u32}
  T3 = enum{"Vrms", "Vpk", "Vrms^2", "Vpk^2", "Vrms/rtHz", "Vpk/rtHz", "Vrms^2/Hz", "Vpk^2/Hz"}
  T4 = cluster{"display unit": T3, "dB type": enum{"Linear", "dB", "dBm"}}
  T5 = cluster{"IQ Rate": f64, "Frames": i32, "Length of Subset": i32, "Start Carrier [Hz": f64, "Stop Carrier [Hz]": f64, "Acq Duration [Sec]": f64, "Start Index of Subset": i32}
  "Power Detection cluster.gtype" = cluster{"Estimated Freqs. above Threshold": f64[], "Power at those Freqs.": f64[], "Num. peaks detected": i32, "Num. in queue": i32}
diagram:
  call "niUSRP Open Rx Session.gvi"(niUSRP Device=$"Device Names") -> (error out=w1, session handle out=w2)
  call "Set Parameters.gvi"(RX Parameters In=$"RX Parameters In", USRP Session Handle In=w2, error in (no error)=w1, IQ frac=$"IQ frac") -> (error out: HW RX Param subsetup=w3, USRP Session Handle Out=w4, Test Carrier Frequencies=w5, Samples per Acquisition=w6, Frame Parameters Out=w7, IQ frac out=w8)
  Property Node(instance in=$"Averaging Parameters") -> ("number of averages"=w9, instance out=w10)
  call "niUSRP Configure Number of Samples.gvi"(session handle=w4, number of samples is finite=TRUE, number of samples=w6, error in (no error)=w3) -> (session handle out=w11, Error Out=w12)
  To Long Integer(number=w9) -> w13
  # Testing Spectrum Monitor. Not as many indicators will
  # be on panel in final version.
  w14 = $"Queue Name"
  w15 = $Display
  w16 = $"Queue Name"
  w17 = $threshold
  s1 = w12  # shift register
  while {
    Is First Call() -> w18
    # Go back to the first carrier frequency and repeat
    s2 = 0  # shift register
    for (iteration -> i1) {
      w19 = each element of w5
      call "Set Carrier and LO_2.gvi"(Current Frequency=w19, niusrp in_2=w11, error in=s1) -> (Error=w20, Usrp.niUSRPClass=w21)
      call "Queue Indices for Sub-band.gvi"(First call=w18, Queue Name=w14, niusrp in=w21, error in=w20, IQ frac=w8) -> (Local Interests=w22, error out=w23, Usrp.niUSRPClass out=w24)
      # Get new carrier frequency
      for (N = w13) (iteration -> i2) {
        # Averaging Loop
        call "Read Data.gvi"(USRP Session Handle In=w24, error in=w23, Number of Samples=w6) -> (USRP Session Handle Out=w26, error out=w27, data=w28)
        Is Equal To 0(x=i2) -> w29
        call "Establish Sub-band.gvi"(Restart Averaging=w29, Frame Parameters=w7, Averaging Parameters=w10, error in=w27, Input Baseband IQ=w28) -> (Power Spectrum averaged Subset=w30, Window Properties=w31, error out=w32, Frame Parameters Out=w33, power spectrum current=w34)
        call "Gather Signals for Saving.gvi"(Local Interests=w22, power spectrum current=w34)
        # w29: First Rx for this carrier?
        Logical Or(w32, $"Stop Capture") -> w35
        append w32 to w25
        stop if w35
      }
      Merge Errors(w25) -> (error out=w36)
      Property Node(instance in=w26, error in=w36) -> ("Carrier Frequency"=w37, "LO Frequency"=w38, error out=w39, instance out=w40)
      $"Carrier Freq Out" <- w37
      $"LO Frequency" <- w38
      call "Aggregate Sub-band into Spectrum.gvi"(Frame Parameters=w33, Power Spectrum Subset=w30, Window Properties In=w31, Display=w15, Iteration=i1) -> (Spectrum to Plot=w41, Frame Parameters Out=w42, Spectrum Size=w43)
      call "Plot Spectrum.gvi"(Frame Parameters=w42, Spectrum to Plot In=w41) -> (Spectrum to Plot Out=w44, Frame Parameters out=w45)
      $"FFT Power Spectrum" <- w44
      $"Spectrum Size" <- w43
      next s2 = w38
      stop if w35
    }
    call "Signal Power Detection_2.gvi"(Power Spectrum=w44, threshold=w17, Frame Parameters=w45) -> (Power at those Freqs.=w46, Est. Freqs above Thresh=w47, count=w48, sub_band_ind=w49)
    call "Queue Fill.gvi"(sub_band_ind=w49, Est. Freqs above Thresh=w47, Queue Name=w16, Count=w48) -> (queueRefOut(Freq,Ind)=w50, error out=w51, number elements in queue=w52)
    Build Cluster(w47, w46, w48, w52) -> w53
    $"Power Detection" <- w53
    next s1 = w51
    stop if w35
  }
  call "niUSRP Abort.gvi"(Handle in=w40, error in (no error)=w39) -> (Handle out=w54, Error Out=w55)
  call "niUSRP Close Session.gvi"(handle in=w54, error in=w55) -> (error out=w56)
  $"error out" <- w56
  Release Queue(error in=s1, queue=w50) -> (error out=w57)
  call "Simple Error Handler.gvi"(error in=w57)
  $"Carrier List" <- w5
  $"Samples per Acquisition" <- w6
  $"Frame Parameters Out" <- w7
