vi "Spectrum Monitor.gvi"   [LabVIEW Communications System Design Software 2.0.1]
panel controls:
  "RX Parameters In": T1 = {"IQ Sampling Rate [S/sec]"=20000000, "Gain [dB]"=0, "Reference Frequency"="Internal", "Timebase Clock Source"="Internal", "Start Carrier [Hz]"=95000000, "Stop Carrier [Hz]"=105000000, "Acq Duration [sec]"=0.0001, "Active Antenna"="RX2"}
  "Device Names": "niUSRPClass" = "192.168.10.2"
  "Averaging Parameters": "Averaging Parameters.gtype" = {"averaging mode"="RMS averaging", "weighting mode"="Linear", "number of averages"=4}  # averaging parameters defines how the averaging is computed. The specifications of the parameters include the type of averaging, the type of weighting, and the number of averages.
  "Display": T4 = {"display unit"="Vrms", "dB type"="dB"}
  "Stop Capture": bool
  "Tab": i32
  "threshold": f64 = -40
  "IQ frac": enum{"0.25", "0.5", "0.6", "0.8"} = "0.25"
  "file path": path
  "Waterall History Length": i32 = 1
  "Compress Frequency Bins?": bool
panel indicators:
  "error out": error
  "Samples per Acquisition": i64
  "Carrier Freq Out": f64
  "FFT Power Spectrum": cluster{"f0": f64, "df": f64, "IQ": f64[]}
  "LO Frequency": f64
  "Carrier List": f64[]
  "Power Detection": "Power Detection cluster.gtype"
  "2D(freq,ind)": f64[][]
  "signals3D": i16[][][]
  "Waterfall Plot": f64[][]
  "current refresh (ms)": u32
  "average period (ms)": f64
  "Spectrum Size": i32
  "Frame Parameters Out": T5
  "Signal Data": "Signal Data.gtype"
types:
  T1 = cluster{"IQ Sampling Rate [S/sec]": f64, "Gain [dB]": f64, "Reference Frequency": string, "Timebase Clock Source": string, "Start Carrier [Hz]": f64, "Stop Carrier [Hz]": f64, "Acq Duration [sec]": f64, "Active Antenna": string}
  T2 = enum{"No averaging", "Vector averaging", "RMS averaging", "Peak hold"}
  "Averaging Parameters.gtype" = cluster{"averaging mode": T2, "weighting mode": enum{"Linear", "Exponential"}, "number of averages": u32}
  T3 = enum{"Vrms", "Vpk", "Vrms^2", "Vpk^2", "Vrms/rtHz", "Vpk/rtHz", "Vrms^2/Hz", "Vpk^2/Hz"}
  T4 = cluster{"display unit": T3, "dB type": enum{"Linear", "dB", "dBm"}}
  T5 = cluster{"IQ Rate": f64, "Frames": i32, "Length of Subset": i32, "Start Carrier [Hz": f64, "Stop Carrier [Hz]": f64, "Acq Duration [Sec]": f64, "Start Index of Subset": i32}
  "Power Detection cluster.gtype" = cluster{"Estimated Freqs. above Threshold": f64[], "Power at those Freqs.": f64[], "Num. peaks detected": i32, "Num. in queue": i32}
  "Signal Data.gtype" = cluster{"fc": f64[], "df": f64, "B": u32, "Trigger Save?": bool}
diagram:
  call "niUSRP Open Rx Session.gvi"(niUSRP Device=$"Device Names") -> (error out=w1, session handle out=w2)
  call "Set Parameters.gvi"(RX Parameters In=$"RX Parameters In", USRP Session Handle In=w2, error in (no error)=w1, IQ frac=$"IQ frac") -> (error out: HW RX Param subsetup=w3, USRP Session Handle Out=w4, Test Carrier Frequencies=w5, Samples per Acquisition=w6, Frame Parameters Out=w7, IQ frac out=w8)
  call "niUSRP Configure Number of Samples.gvi"(session handle=w4, number of samples is finite=TRUE, number of samples=w6, error in (no error)=w3) -> (session handle out=w9, Error Out=w10)
  w11 = $"Waterall History Length"
  w12 = $"file path"
  Tick Count() -> (timer value=w13)
  # Testing Spectrum Monitor. Not as many indicators will
  # be on panel in final version.
  s1 = uninitialised  # shift register
  while (iteration -> i1) {
    w15 = $"Averaging Parameters"
    Is First Call() -> w16
    w17 = $Display
    w18 = $Display
    # Go back to the first carrier frequency and repeat
    s2 = 0  # shift register
    for (iteration -> i2) {
      w19 = each element of w5
      # Get new carrier frequency
      Property Node(instance in=w15) -> ("number of averages"=w23, instance out=w24)
      call "Set Carrier and LO_2.gvi"(Current Frequency=w19, niusrp in_2=w9, error in=w10) -> (Error=w25, Usrp.niUSRPClass=w26)
      call "Array Indices for Sub-band.gvi"(First call=w16, error in=w25, 2D(freq,ind)=s1, niusrp in=w26, IQ frac=w8) -> (Local Interests=w27, error out=w28, Usrp.niUSRPClass out=w29)
      To Long Integer(number=w23) -> w30
      for (N = w30) (iteration -> i3) {
        Get Current Time() -> (current time=w33)
        # Averaging Loop
        call "Read Data.gvi"(USRP Session Handle In=w29, error in=w28, Number of Samples=w6) -> (USRP Session Handle Out=w34, error out=w35, data=w36)
        Is Equal To 0(x=i3) -> w37
        call "Establish Sub-band.gvi"(Restart Averaging=w37, Frame Parameters=w7, Averaging Parameters=w24, error in=w35, Input Baseband IQ=w36) -> (Power Spectrum averaged Subset=w38, Window Properties=w39, error out=w40, Frame Parameters Out=w41, power spectrum current=w42)
        call "Gather Signals for Saving.gvi"(Local Interests=w27, power spectrum current=w42, Window Properties=w39, Display=w17) -> (Signal Data=w43, signals2D=w44)
        # w37: First Rx for this carrier?
        Logical Or(w40, $"Stop Capture") -> w45
        append w40 to w31
        append w44 to w32
        stop if w45
      }
      $signals3D <- w32
      Merge Errors(w31) -> (error out=w46)
      Property Node(instance in=w34, error in=w46) -> ("Carrier Frequency"=w47, "LO Frequency"=w48, error out=w49, instance out=w50)
      $"Carrier Freq Out" <- w47
      $"Signal Data" <- w43
      $"LO Frequency" <- w48
      call "Aggregate Sub-band into Spectrum.gvi"(Frame Parameters=w41, Power Spectrum Subset=w38, Window Properties In=w39, Display=w18, Iteration=i2) -> (Spectrum to Plot=w51, Frame Parameters Out=w52, Spectrum Size=w53)
      call "Plot Spectrum.gvi"(Frame Parameters=w52, Spectrum to Plot In=w51) -> (Spectrum to Plot Out=w54, Frame Parameters out=w55)
      $"FFT Power Spectrum" <- w54
      $"Spectrum Size" <- w53
      append w32 to w20
      append w33 to w21
      append w43 to w22
      next s2 = w48
      stop if w45
    }
    call "Save Data to File ALT.gvi"(Signal Data Array=w22, file path=w12, Timestamp Array=w21, Signal 4D=w20)
    call "Signal Power Detection_2.gvi"(Power Spectrum=w54, threshold=$threshold, Frame Parameters Out=w55) -> (Power at those Freqs.=w56, Est. Freqs above Thresh=w57, count=w58, sub_band_ind=w59)
    call "Array Fill.gvi"(sub_band_ind=w59, Est. Freqs above Thresh=w57, Count=w58) -> (2D(freq,ind)=w60, number elements in array=w61)
    $"2D(freq,ind)" <- w60
    Build Cluster(w57, w56, w58, w61) -> w62
    $"Power Detection" <- w62
    Tick Count() -> (timer value=w63)
    Feedback Node(initial value=w13, input=w63) -> w64
    Subtract(x=w63, y=w64) -> w65
    To Double Precision Float(number=w65) -> w66
    call "Waterfal Plot Generator.gvi"(Compress?=$"Compress Frequency Bins?", FFT Power Spectrum=w54, Waterfall History Length=w11) -> (Waterfall Plot=w67)
    $"Waterfall Plot" <- w67
    $"current refresh (ms)" <- w65
    append w66 to w14
    next s1 = w60
    stop if w45
  }
  call "niUSRP Abort.gvi"(Handle in=w50, error in (no error)=w49) -> (Handle out=w68, Error Out=w69)
  call "niUSRP Close Session.gvi"(handle in=w68, error in=w69) -> (error out=w70)
  $"error out" <- w70
  Add Array Elements(numeric array=w14) -> (sum=w71: f64)
  Divide(x=w71, y=i1) -> w72
  $"average period (ms)" <- w72
  $"Carrier List" <- w5
  $"Samples per Acquisition" <- w6
  $"Frame Parameters Out" <- w7
