vi "USRP Aggregate Spectrum.gvi"   [LabVIEW Communications System Design Software 2.0.1]
inputs:
  "Frame Parameters": T1
  "error in": error
  "Input Baseband IQ": c128[]
  "Window Parameters": T2 = {"window type"=0, "window parameter"=NaN}
  "Reset": bool
  "Iteration": i32
  "Averaging Parameters": "Averaging Parameters.gtype" = {"averaging mode"="No averaging", "weighting mode"="Exponential", "number of averages"=10}  # averaging parameters defines how the averaging is computed. The specifications of the parameters include the type of averaging, the type of weighting, and the number of averages.
  "Restart Averaging": bool
outputs:
  "Window Properties": T3
  "error out": error
  "Spectrum to Plot": cluster{"f0": f64, "df": f64, "IQ": f64[]}
  "Frame Parameters Out": T1
panel controls:
  "Window Properties Init": T3
  "Initialize Spectrum": cluster{"f0": f64, "df": f64, "IQ": f64[]}
panel indicators:
  "Sizes (testing)": T5
types:
  T1 = cluster{"IQ Rate": f64, "Frames": i32, "Length of Subset": i32, "Start Carrier [Hz": f64, "Stop Carrier [Hz]": f64, "Acq Duration [Sec]": f64, "Start Index of Subset": i32}
  "windowTd.gtype" = u32
  T2 = cluster{"window type": "windowTd.gtype", "window parameter": f64}
  T3 = cluster{"eq noise bw": f64, "coherent gain": f64}
  T4 = enum{"No averaging", "Vector averaging", "RMS averaging", "Peak hold"}
  "Averaging Parameters.gtype" = cluster{"averaging mode": T4, "weighting mode": enum{"Linear", "Exponential"}, "number of averages": u32}
  T5 = cluster{"Before Edges Cut": i32, "After Edges Cut": i32, "Total Samples in Spectrum": i32}
uses:
  NI::Analysis::Measurement::Power Spectrum for 1 Chan (CDB).gvi
  NI::Analysis::Windows::Window Properties by Name.gvi
diagram:
  Property Node(instance in=$"Frame Parameters") -> ("IQ Rate"=w1, "Frames"=w2, "Length of Subset"=w3, "Start Index of Subset"=w4, instance out=w5)
  Multiply(w2, w3) -> w6
  # Reset is unused
  Is First Call() -> w7
  Logical Or(w7, $Reset) -> w8
  Property Node(instance in=$"Window Parameters") -> ("window type"=w9, "window parameter"=w10)
  Reciprocal(x=w1) -> w11
  Build Waveform Node(Y=$"Input Baseband IQ", dt=w11) -> (output waveform=w12)
  # w4: Start Index
  call "Power Spectrum for 1 Chan (CDB).gvi"(signal=w12, window type=w9, averaging parameters=$"Averaging Parameters", error in=$"error in", restart averaging=$"Restart Averaging", window parameter=w10) -> (power spectrum=w13, error out=w14)
  Property Node(instance in=w13) -> ("df"=w15, "magnitude"=w16)
  Feedback Node(input=w17) -> w18
  case (w8) {
    frame False, Default {
      w19 = w18
    }
    frame True {
      Initialize Array(element=0, size=w6) -> w20
      # Initialize Spectrum History
      Property Node(instance in=$"Initialize Spectrum", "df"=w15, "IQ"=w20) -> (instance out=w19)
    }
  }
  # Remove Edges of
  # Sub Spectrum
  Array Subset(array=w16, index0=w4, length0=w3) -> w21
  Multiply($Iteration, w3) -> w22
  in-place (after w19) {
    Unbundle Bundle Read Poser() -> ("IQ"=w23)
    # Add Current Spectrum to Spectrum History
    Replace Array Subset(inArray=w23, index=w22, new=w21) -> w24
    Unbundle Bundle Write Poser("IQ"=w24)
    w17 = _
  }
  $"Spectrum to Plot" <- w17
  # w3: Length of Subset
  $"Frame Parameters Out" <- w5
  $"error out" <- w14
  Array Size(array=w16) -> (size(s)=w25)
  Array Size(array=w21) -> (size(s)=w26)
  Property Node(instance in=w17) -> ("IQ"=w27)
  Array Size(array=w27) -> (size(s)=w28)
  Build Cluster(w25, w26, w28) -> w29
  $"Sizes (testing)" <- w29
  Array Size(array=$"Input Baseband IQ") -> (size(s)=w30)
  call "Window Properties by Name.gvi"(size=w30, window type=w9, window parameter=w10) -> (eq noise bw=w31, coherent gain=w32)
  Property Node(instance in=$"Window Properties Init", "eq noise bw"=w31, "coherent gain"=w32) -> (instance out=w33)
  $"Window Properties" <- w33
