vi "Save Data to File attempt.gvi"   [LabVIEW Communications System Design Software 2.0.1]
inputs:
  "file path": path
  "Signals3D": f64[][][]
  "Signal Data": "Signal Data.gtype"
panel controls:
  "playback info": string[]
types:
  "Signal Data.gtype" = cluster{"fc": f64[], "df": f64, "B": u32, "Trigger Save?": bool}
diagram:
  Is First Call() -> w1
  case (w1) {
    frame False, Default {
      TDMS Open(file path=$"file path", operation="open") -> (tdms file out=w2)
    }
    frame True {
      TDMS Open(disable buffering=TRUE, file path=$"file path", operation="create or replace") -> (tdms file out=w2)
    }
  }
  Property Node(instance in=$"Signal Data") -> ("fc"=w3, "df"=w4, "B"=w5, "Trigger Save?"=w6)
  # signals3D:
  # 	The added third dimension corresponds to a time of recording,
  # 	the nth iteration of the averaging loop.
  # 	Each row is a different signal that peaked above threshold
  # f0:
  # 	Beginning frequency of signal.
  # Trigger Save?:
  # 	Boolean indicating whether to save this data
  # df:
  # 	Common df for the recorded signals
  for {
    w7 = each element of $Signals3D
    case (w6) {
      frame False, Default {
        w8 = w2
      }
      frame True {
        Multiply(w4, w5) -> w9
        for {
          w10 = each element of w7
          w11 = each element of w3
          Divide(x=w11, y=1000000) -> w12
          Number To Fractional String(number=w12, precision (6)=1) -> (F-format string=w13)
          Concatenate Strings(w13, "M") -> w14
          # w15: f0
          Subtract(x=w11, y=w9) -> w15
          Build Array(w15, w4, w5) -> w16
          TDMS Write(data=w10, group name in=w14, tdms file=w2) -> (tdms file out=w17)
          TDMS Write(channel name(s) in=$"playback info", data=w16, group name in=w14, tdms file=w17) -> (tdms file out=w8)
        }
      }
    }
  }
  TDMS Close(tdms file=w8)
