vi "Set Carrier and LO.gvi"   [LabVIEW Communications System Design Software 2.0.1]
inputs:
  "Current Frequency": f64
  "LO Frequency": f64
  "niusrp in_2": "niUSRPClass"
  "error in": error
outputs:
  "Error": error
  "Usrp.niUSRPClass": "niUSRPClass"
diagram:
  Subtract(x=$"LO Frequency", y=$"Current Frequency") -> w1
  Absolute Value(x=w1) -> w2
  Is Greater(x=w2, y=10000000) -> w3
  # In this version, the local oscillator is updated
  # in order to minimize the amount of times it needs
  # to lock to a certain frequency
  # w3: Update LO?
  case (w3) {
    frame False, Default {
      Property Node(instance in=$"niusrp in_2", "Carrier Frequency"=$"Current Frequency", error in=$"error in") -> (error out=w5, instance out=w4)
    }
    frame True {
      Add($"Current Frequency", 10000000) -> w6
      Property Node(instance in=$"niusrp in_2", "Carrier Frequency"=$"Current Frequency", "LO Frequency"=w6, error in=$"error in") -> (error out=w5, instance out=w4)
    }
  }
  $"Usrp.niUSRPClass" <- w4
  $Error <- w5
