vi "Signal Power Detection.gvi"   [LabVIEW Communications System Design Software 2.0.1]
inputs:
  "Power Spectrum": cluster{"f0": f64, "df": f64, "IQ": f64[]}
  "threshold": f64
outputs:
  "Power at those Freqs.": f64[]
  "Est. Freqs above Thresh": f64[]
  "count": i32
uses:
  NI::Analysis::Measurement::Threshold Detector.gvi
diagram:
  Property Node(instance in=$"Power Spectrum") -> ("f0"=w1, "df"=w2, "IQ"=w3)
  # Adjust parameter for signal width
  # desired above threshold.
  # w4: indices
  call "Threshold Detector.gvi"(signal=w3, threshold=$threshold, width=2) -> (indices=w4, count=w5)
  # w2: note, df = sample rate / samples
  Array Size(array=w4) -> (size(s)=w6)
  # Returns first index of a peak above threshold,
  # but doesn't return the index of max in the group.
  for (N = w6) {
    w7 = each element of w4
    Array Subset(array=w3, index0=w7, length0=2) -> w10
    Array Max And Min(array=w10) -> (max index(es)=w11)
    Add(w11, w7) -> w12
    Array Index(array=w3) -> (out0[w12]=w13)
    append w13 to w8
    append w12 to w9
  }
  Multiply(w2, w9) -> w14
  Add(w1, w14) -> w15
  $"Est. Freqs above Thresh" <- w15
  $"Power at those Freqs." <- w8
  $count <- w5
