vi "Spectrum History_2.gvi"   [LabVIEW Communications System Design Software 2.0.1]
inputs:
  "Waterfall Time Scale (s)": i32 = 5
  "Magnitude": f64[]
outputs:
  "Waterfall Plot": f64[][]
panel controls:
  "Downsampling Factor": i32 = 5
panel indicators:
  "Array": f64[]
diagram:
  # w1: Number of Samples
  Array Size(array=$Magnitude) -> (size(s)=w1)
  Is First Call() -> w2
  case (w2) {
    frame False, Default {
      w3 = default
    }
    frame True {
      Initialize Array(element=-120, size=w1, size=$"Waterfall Time Scale (s)") -> w3
    }
  }
  Feedback Node(initial value=w3, input=w4) -> w5
  Insert Into Array(inArray=w5, index1=0, new=$Magnitude) -> w6
  Delete From Array(inArray=w6, length (1)=w1, index1=$"Waterfall Time Scale (s)") -> w4
  $"Waterfall Plot" <- w4
  w7 = $"Downsampling Factor"
  Quotient And Remainder(x=w1, y=w7) -> (floor(x/y)=w8)
  s1 = uninitialised  # shift register
  for (N = w8) (iteration -> i1) {
    Is Equal To 0(x=i1) -> w9
    Multiply(i1, w7) -> w10
    # w10: Downsample Factor * Num Samples
    Array Subset(array=$Magnitude, index0=w10, length0=w7) -> w11
    Add Array Elements(numeric array=w11) -> (sum=w12)
    Divide(x=w12, y=w7) -> w13
    case (w9) {
      frame False, Default {
        Insert Into Array(inArray=s1, index0=i1, new=w13) -> w14
      }
      frame True {
        Initialize Array(element=w13, size=w8) -> w14
      }
    }
    next s1 = w14
  }
  $Array <- s1
