vi "Waterfal Plot Generator.gvi"   [LabVIEW Communications System Design Software 2.0.1]
inputs:
  "Compress?": bool
  "FFT Power Spectrum": cluster{"f0": f64, "df": f64, "IQ": f64[]}
  "Waterfall History Length": i32 = 5
outputs:
  "Waterfall Plot": f64[][]
diagram:
  Property Node(instance in=$"FFT Power Spectrum") -> ("IQ"=w1)
  Math Node("Compress"=$"Compress?", "vec0"=w1) -> ("vec1"=w2, "len"=w3)
  ~~~
  vec1 = vec0;
  if Compress
      rf= 5; %reduction factor
      len = floor(length(vec0)/rf);
      vec1 = reshape(vec1(1:len*rf),rf,len);
      vec1 = mean(vec1,1)
  else
      len = length(vec1);
  end
  ~~~
  Is First Call() -> w4
  case (w4) {
    frame False, Default {
      w5 = default
    }
    frame True {
      Initialize Array(element=-120, size=w3, size=$"Waterfall History Length") -> w5
    }
  }
  Feedback Node(initial value=w5, input=w6) -> w7
  Insert Into Array(inArray=w7, index1=0, new=w2) -> w8
  Delete From Array(inArray=w8, index1=$"Waterfall History Length") -> w6
  $"Waterfall Plot" <- w6
