vi "Write Rx Properties.gvi"   [LabVIEW Communications System Design Software 2.0.1]
inputs:
  "RX Parameters In": T1
  "USRP Session Handle In": "niUSRPClass"
  "error in (no error)": error
outputs:
  "RX Parameters Out": T1
  "USRP Session Handle Out": "niUSRPClass"
  "error out": error
panel indicators:
  "Reference Frequency Source_2": string
  "Timebase Clock Source_2": string
types:
  T1 = cluster{"IQ Sampling Rate [S/sec]": f64, "Gain [dB]": f64, "Active Antenna": string, "Reference Frequency": string, "Timebase Clock Source": string, "Start Carrier [Hz]": f64, "Stop Carrier [Hz]": f64, "Acq Duration [sec]": f64}
diagram:
  Property Node(instance in=$"RX Parameters In") -> ("IQ Sampling Rate [S/sec]"=w1, "Gain [dB]"=w2, "Active Antenna"=w3, "Reference Frequency"=w4, "Timebase Clock Source"=w5, "Start Carrier [Hz]"=w6, "Stop Carrier [Hz]"=w7, instance out=w8)
  Property Node(instance in=$"USRP Session Handle In", sub-item="0", "IQ Rate"=w1, "Gain"=w2, "Active Antenna"=w3, "Reference Frequency Source"=w4, "Timebase Clock Source"=w5, "Carrier Frequency"=w6, error in=$"error in (no error)") -> ("IQ Rate"=w9, "Gain"=w10, "Carrier Frequency"=w11, error out=w12, instance out=w13)
  call "niUSRP Commit.gvi"(session handle=w13, error in (no error)=w12) -> (session handle out=w14, Error Out=w15)
  $"USRP Session Handle Out" <- w14
  $"error out" <- w15
  # Max Freq for USRP 2920
  Is Less(x=w7, y=2200000000) -> w16
  Select(s=w16, t=w7, f=2200000000) -> w17
  Property Node(instance in=w8, "IQ Sampling Rate [S/sec]"=w9, "Gain [dB]"=w10, "Start Carrier [Hz]"=w11, "Stop Carrier [Hz]"=w17) -> (instance out=w18)
  $"RX Parameters Out" <- w18
