vi "Signal Power Detection.gvi"   [LabVIEW Communications System Design Software 2.0.1]
inputs:
  "power spectrum_2": T1
  "threshold": f64
outputs:
  "Freqs at Pk Power": f64[]
  "indices": i32[]
  "num groups over threshold": i32
types:
  T1 = cluster{"f0": f64, "df": f64, "magnitude": f64[]}
uses:
  NI::Analysis::Measurement::Threshold Detector.gvi
diagram:
  Property Node(instance in=$"power spectrum_2") -> ("df"=w1, "magnitude"=w2)
  # w1: note, df = sample rate / samples
  call "Threshold Detector.gvi"(signal=w2, threshold=$threshold, width=1) -> (indices=w3, count=w4)
  Multiply(w1, w3) -> w5
  $"Freqs at Pk Power" <- w5
  $indices <- w3
  $"num groups over threshold" <- w4
