vi "Spectrum History.gvi"   [LabVIEW Communications System Design Software 2.0.1]
inputs:
  "Magnitude": f64[]
outputs:
  "Waterfall Plot": f64[][]
diagram:
  # w1: Number of Samples
  Array Size(array=$Magnitude) -> (size(s)=w1)
  Is First Call() -> w2
  # rows are x values (freq)
  # columns are y values (time)
  case (w2) {
    frame False, Default {
      w3 = default
    }
    frame True {
      Initialize Array(element=-120, size=w1, size=20) -> w3
    }
  }
  Feedback Node(initial value=w3, input=w4) -> w5
  Insert Into Array(inArray=w5, index1=0, new=$Magnitude) -> w6
  Delete From Array(inArray=w6, index1=20) -> w4
  $"Waterfall Plot" <- w4
