vi "Test2Darray.gvi"   [LabVIEW Communications System Design Software 2.0.1]
panel indicators:
  "size?": i32
  "size(s)": i32[]
  "Array": f64[][]
  "Variable: A": f64[][][]
  "Array_2": f64[]
diagram:
  Math Node() -> ("A"=w1)
  ~~~
  A = 1:16;
  A = reshape(A,[2 2 4]);
  ~~~
  Array Size(array=w1) -> (size(s)=w2)
  $"size(s)" <- w2
  Array Index(array=w2) -> (out0[1]=w3)
  $"size?" <- w3
  for {
    w4 = each element of w1
    $Array <- w4
    Wait(time to wait=500)
  }
  $"Variable: A" <- w1
  for {
    w5 = each element of w1
    for {
      w6 = each element of w5
      $Array_2 <- w6
    }
  }
