vi "Waterfal Plot Generator.gvi"   [LabVIEW Communications System Design Software 2.0.1]
inputs:
  "Compress?": bool
  "FFT Power Spectrum": cluster{"f0": f64, "df": f64, "IQ": f64[]}
  "Waterfall History Length": i32 = 5
outputs:
  "Waterfall Plot": f64[][]
diagram:
  Property Node(instance in=$"FFT Power Spectrum") -> ("IQ"=w1)
  Math Node("Compress"=$"Compress?", "vec0"=w1) -> ("vec1"=w2, "len"=w3)
  ~~~
  if Compress
      reduction_factor = 5;
      len = floor(length(vec0)/reduction_factor);
      vec1 = zeros(1,len);
      for ii = 1:len
          jj = ii*5-2;
          vec1(ii) = mean(vec0(jj-2:jj+2));
      end
  else
      vec1 = vec0;
      len = length(vec1);
  end
  ~~~
  Is First Call() -> w4
  case (w4) {
    frame False, Default {
      w5 = default
    }
    frame True {
      Initialize Array(element=-120, size=w3, size=$"Waterfall History Length") -> w5
    }
  }
  Feedback Node(initial value=w5, input=w6) -> w7
  Insert Into Array(inArray=w7, index1=0, new=w2) -> w8
  Delete From Array(inArray=w8, index1=$"Waterfall History Length") -> w6
  $"Waterfall Plot" <- w6
