vi "stft.gvi"   [LabVIEW Communications System Design Software 2.0.1]
panel controls:
  "tone amplitudes": f64[]
  "tone frequencies": f64[]
  "stop": bool
  "tone phases": f64[]
panel indicators:
  "Intensity Graph": f64[][]
  "Graph": T1
  "loop iteration": i32
  "Numeric": f64
  "Waterfall Plot": f64[][]
  "Graph_2": T1
types:
  T1 = cluster{"f0": f64, "df": f64, "magnitude": f64[]}
uses:
  NI::Analysis::Generation::Tones and Noise Waveform.gvi
  NI::Analysis::Measurement::Power Spectrum for 1 Chan.gvi
  NI::Analysis::Measurement::STFT Spectrogram.gvi
diagram:
  s1 = $"tone frequencies"  # shift register
  while (iteration -> i1) {
    Array Index(array=s1) -> (out0[0]=w1)
    Add(w1, 50) -> w2
    Is Less(x=500, y=w2) -> w3
    case (w3) {
      frame False, Default {
        w4 = w2
      }
      frame True {
        w4 = 50
      }
    }
    Replace Array Subset(inArray=s1, index=0, new=w4) -> w5
    call "Tones and Noise Waveform.gvi"(tone amplitudes=$"tone amplitudes", noise amplitude=0.5, tone frequencies=w5, tone phases=$"tone phases") -> (tones and noise=w6)
    call "Power Spectrum for 1 Chan.gvi"(signal=w6, dB on=TRUE) -> (power spectrum=w7)
    $Graph_2 <- w7
    call "STFT Spectrogram.gvi"(x=w6) -> (STFT spectrogram=w8)
    $"Intensity Graph" <- w8
    call "Power Spectrum for 1 Chan.gvi"(signal=w6, dB on=TRUE, restart averaging=TRUE) -> (power spectrum=w9)
    $Graph <- w9
    call "Waterfal Plot Generator.gvi"(Compress?=TRUE, FFT Power Spectrum=w9, Waterfall History Length=20) -> (Waterfall Plot=w10)
    $"Waterfall Plot" <- w10
    $Numeric <- w4
    Wait(time to wait=350)
    $"loop iteration" <- i1
    next s1 = w5
    stop if $stop
  }
