vi "testrecord.gvi"   [LabVIEW Communications System Design Software 2.0.1]
panel controls:
  "loop count": i32
  "Cluster": T2 = {"samples"=1000, "sample rate"=1000, "frequency"=10, "threshold "=0, "Threshold in dB?"=FALSE}
panel indicators:
  "size(s)": i32
  "Array": string[]
  "Graph": waveform<f64>[]
  "indices": i32[]
  "num groups over threshold": i32
  "power spectrum data": T1
  "Power Spectrum": T1
  "Freqs at Pk Power": f64[]
types:
  T1 = cluster{"f0": f64, "df": f64, "magnitude": f64[]}
  T2 = cluster{"samples": i32, "sample rate": f64, "frequency": f64, "threshold ": f64, "Threshold in dB?": bool}
uses:
  NI::Analysis::Generation::Sine Waveform.gvi
  NI::Analysis::Generation::Square Waveform.gvi
  NI::Analysis::Measurement::Power Spectrum for 1 Chan.gvi
diagram:
  call "Sine Waveform.gvi"() -> (sine wave=w1)
  Property Node(instance in=$Cluster) -> ("samples"=w2, "sample rate"=w3, "frequency"=w4, "threshold "=w5, "Threshold in dB?"=w6)
  call "Square Waveform.gvi"(frequency=w4, sample rate=w3, samples=w2) -> (square wave=w7)
  w8 = $"loop count"
  # cwd
  Get Component Directory() -> (Path=w9)
  Build Path(base path=w9, name or relative path=path "test_data.tdms") -> (appended path=w10)
  TDMS Open(file path=w10, operation="create or replace") -> (error out=w11, tdms file out=w12)
  for (N = w8) (iteration -> i1) {
    Build Array(w1, w7) -> w13
    $Graph <- w13
    Format Into String(initString="Group", i1) -> w14
    Array Size(array=w13) -> (size(s)=w15)
    for (N = w15) (iteration -> i2) {
      Format Into String(initString="Channel", i2) -> w17
      append w17 to w16
    }
    TDMS Write(channel name(s) in=w16, data=w13, error in=w11, group name in=w14, tdms file=w12) -> (error out=w18, tdms file out=w19)
    $"size(s)" <- w15
    # I read this is the best way
    # to initialize arrays.
    $Array <- w16
  }
  # Thinking about converting .tdms files
  # to .mat files at a later time.
  TDMS Close(error in=w18, tdms file=w19) -> (error out=w20)
  call "Display Error.gvi"(error in=w20)
  call "Power Spectrum for 1 Chan.gvi"(signal=w7, dB on=w6) -> (power spectrum=w21)
  $"power spectrum data" <- w21
  $"Power Spectrum" <- w21
  call "Signal Power Detection.gvi"(power spectrum_2=w21, threshold=w5) -> (Freqs at Pk Power=w22, indices=w23, num groups over threshold=w24)
  $"Freqs at Pk Power" <- w22
  $indices <- w23
  $"num groups over threshold" <- w24
