vi "Aggregate Spectrum.gvi"   [LabVIEW Communications System Design Software 2.0.1]
panel controls:
  "RX Parameters In": T1 = {"IQ Sampling Rate [S/sec]"=10000000, "Gain [dB]"=0, "Active Antenna"="RX2", "Reference Frequency"="Internal", "Timebase Clock Source"="Internal", "Start Carrier [Hz]"=91000000, "Stop Carrier [Hz]"=101000000, "Acq Duration [sec]"=0.0001}
  "Device Names": "niUSRPClass" = "192.168.10.2"
  "Averaging Parameters": "Averaging Parameters.gtype" = {"averaging mode"="RMS averaging", "weighting mode"="Linear", "number of averages"=10}  # averaging parameters defines how the averaging is computed. The specifications of the parameters include the type of averaging, the type of weighting, and the number of averages.
  "Display": T4 = {"display unit"="Vrms", "dB type"="dB"}
  "threshold": f64
  "Stop Capture": bool
  "Waterfall Time Scale": i32 = 40
  "file path": path
panel indicators:
  "error out": error
  "FFT Power Spectrum": cluster{"f0": f64, "df": f64, "IQ": f64[]}
  "Samples per Acquisition": i64
  "Carrier Freq Out": f64
  "Freqs above threshold": f64[]
  "indices": i32[]
  "count": i32
  "Waterfall Plot": f64[][]
types:
  T1 = cluster{"IQ Sampling Rate [S/sec]": f64, "Gain [dB]": f64, "Active Antenna": string, "Reference Frequency": string, "Timebase Clock Source": string, "Start Carrier [Hz]": f64, "Stop Carrier [Hz]": f64, "Acq Duration [sec]": f64}
  T2 = enum{"No averaging", "Vector averaging", "RMS averaging", "Peak hold"}
  "Averaging Parameters.gtype" = cluster{"averaging mode": T2, "weighting mode": enum{"Linear", "Exponential"}, "number of averages": u32}
  T3 = enum{"Vrms", "Vpk", "Vrms^2", "Vpk^2", "Vrms/rtHz", "Vpk/rtHz", "Vrms^2/Hz", "Vpk^2/Hz"}
  T4 = cluster{"display unit": T3, "dB type": enum{"Linear", "dB", "dBm"}}
diagram:
  call "niUSRP Open Rx Session.gvi"(device names=$"Device Names") -> (error out=w1, session handle out=w2)
  call "Set Parameters.gvi"(RX Parameters In=$"RX Parameters In", IVI Refnum In=w2, error in (no error)=w1) -> (error out: HW RX Param subsetup=w3, IVI Refnum Out=w4, Test Carrier Frequencies=w5, Samples per Acquisition=w6, Frame Parameters Out=w7)
  $"Samples per Acquisition" <- w6
  w8 = $"Averaging Parameters"
  Property Node(instance in=$"RX Parameters In") -> ("Active Antenna"=w9)
  Property Node(instance in=w8) -> ("number of averages"=w10)
  To Long Integer(number=w10) -> w11
  w12 = $Display
  w13 = $"file path"
  while {
    # Restart at first carrier after end
    for (iteration -> i1) {
      w14 = each element of w5
      # Get new carrier frequency
      for (N = w11) (iteration -> i2) {
        # Averaging Loop
        call "USRP_NI_IQ.gvi"(IVI Refnum In=w4, error in=w3, Number of Samples=w6, Carrier Frequency=w14, Active Antenna=w9) -> (IVI Refnum Out=w15, error out=w16, data=w17, Carrier Freq Out=w18)
        $"Carrier Freq Out" <- w18
        # w19: First Rx for this carrier?
        Is Equal To 0(x=i2) -> w19
        call "USRP Aggregate Spectrum.gvi"(Frame Parameters=w7, Input Baseband IQ=w17, Iteration=i1, Averaging Parameters=w8, Restart Averaging=w19) -> (Window Properties=w20, Spectrum to Plot=w21, Frame Parameters Out=w22)
        call "USRP Plot Spectrum.gvi"(Frame Parameters=w22, Display=w12, Window Properties=w20, Spectrum to Plot In=w21) -> (Spectrum to Plot Out=w23)
        call "Signal Power Detection.gvi"(Power Spectrum=w23, threshold=$threshold) -> (Freqs above threshold=w24, indices=w25, count=w26)
        $"Freqs above threshold" <- w24
        $indices <- w25
        $count <- w26
        stop if $"Stop Capture"
      }
      call "Waterfall Plotter.gvi"(Waterfall Time Scale=$"Waterfall Time Scale", FFT Power Spectrum=w23) -> (Waterfall Plot=w27)
      $"Waterfall Plot" <- w27
      $"FFT Power Spectrum" <- w23
      call "Save Data.gvi"(file path=w13, FFT Power Spectrum=w23) -> (tdms file out=w28)
    }
    stop if $"Stop Capture"
  }
  call "niUSRP Close Session.gvi"(session handle=w15, error in=w16) -> (error out=w29)
  $"error out" <- w29
  TDMS Close(tdms file=w28)
