vi "Aggregate Spectrum_2.gvi"   [LabVIEW Communications System Design Software 2.0.1]
panel controls:
  "Gain (dB)": f64
  "Device Names": string = "192.168.10.2"
  "Start Frequency": f64
  "End Frequency": f64
  "Interval (IQ Rate)": f64
  "Active Antenna": string = "RX1"
  "Timeout": f64 = 10
  "Number of Samples": i64 = 16384
panel indicators:
  "Error Out": error
  "loop iteration": i32
  "Baseband Power Spectrum": T1
  "Coerced Frequency": f64
  "Coerced Gain": f64
  "coerced IQ rate": f64
  "IQ Graph": waveform<f64>[]
types:
  T1 = cluster{"f0": f64, "df": f64, "magnitude": f64[]}
uses:
  NI::Analysis::Measurement::Power Spectrum for 1 Chan (CDB).gvi
diagram:
  call "niUSRP Open Rx Session.gvi"(device names=$"Device Names") -> (error out=w1, session handle out=w2)
  call "niUSRP Configure Signal.gvi"(session handle=w2, IQ rate=$"Interval (IQ Rate)", carrier frequency=$"Start Frequency", gain=$"Gain (dB)", error in=w1, active antenna=$"Active Antenna") -> (session handle out=w3, error out=w4)
  call "niUSRP Initiate.gvi"(session handle=w3, error in=w4) -> (session handle out=w5, error out=w6)
  while (iteration -> i1) {
    Math Node("freq_start"=$"Start Frequency", "freq_end"=$"End Frequency", "interval"=$"Interval (IQ Rate)", "iter"=i1) -> ("current_carrier_freq"=w7, "iq_rate"=w8, "complete"=w9)
    ~~~
    current_carrier_freq = freq_start + interval*iter;
    iq_rate = interval;

    if (current_carrier_freq < freq_end)
        complete = false;
    else
        complete = true;
    end
    ~~~
    Property Node(instance in=w5, "IQ Rate"=w8, "Carrier Frequency"=w7, error in=w6) -> (error out=w10, instance out=w11)
    # There are different Rx blocks that output
    # the data in different forms. I changed your
    #  read block to CDB WDT (complex
    # double analog waveform)
    call "niUSRP Fetch Rx Data (CDB WDT).gvi"(session handle=w11, number of samples=$"Number of Samples", timeout=$Timeout, error in=w10) -> (session handle out=w12, data=w13, error out=w14)
    Property Node(instance in=w12, error in=w14) -> ("IQ Rate"=w15, "Carrier Frequency"=w16, "Gain"=w17, error out=w18, instance out=w19)
    $"coerced IQ rate" <- w15
    $"Coerced Frequency" <- w16
    $"Coerced Gain" <- w17
    # I'm not sure what you were trying to do with
    # the magnitude graph so I removed it temporarily.
    Logical Or(w18, w9) -> w20
    call "Power Spectrum for 1 Chan (CDB).gvi"(signal=w13, dB on=TRUE) -> (power spectrum=w21)
    $"Baseband Power Spectrum" <- w21
    Property Node(instance in=w13) -> ("Y"=w22, "dt"=w23)
    Complex To Real Imaginary(x + iy=w22) -> (x=w24, y=w25)
    Build Waveform Node(Y=w24, dt=w23) -> (output waveform=w26)
    Build Waveform Node(Y=w25, dt=w23) -> (output waveform=w27)
    Build Array(w26, w27) -> w28
    $"IQ Graph" <- w28
    $"loop iteration" <- i1
    stop if w20
  }
  call "niUSRP Abort.gvi"(session handle=w19, error in=w18) -> (session handle out=w29, error out=w30)
  call "niUSRP Close Session.gvi"(session handle=w29, error in=w30) -> (error out=w31)
  $"Error Out" <- w31
