vi "Find Radio Station.gvi"   [LabVIEW Communications System Design Software 2.0.1]
panel controls:
  "device names": string = "192.168.10.2"
  "IQ rate": f64 = 200000
  "carrier frequency": f64 = 50000000
  "gain (dB)": f64
  "active antenna": string = "RX1"
  "timeout": f64 = 10
  "number of samples": f64 = 127
panel indicators:
  "coerced gain": f64
  "coerced frequency": f64
  "coerced IQ rate": f64
  "Frequency Plot": T1
  "Error Out": error
types:
  T1 = cluster{"f0": f64, "df": f64, "magnitude": f64[]}
uses:
  NI::Analysis::Measurement::Power Spectrum for 1 Chan (CDB).gvi
diagram:
  call "niUSRP Open Rx Session.gvi"(niUSRP Device=$"device names") -> (error out=w1, session handle out=w2)
  call "niUSRP Configure Signal.gvi"(session handle=w2, IQ rate=$"IQ rate", carrier frequency=$"carrier frequency", gain=$"gain (dB)", error in (no error)=w1, active antenna=$"active antenna") -> (session handle out=w3, coerced IQ rate=w4, coerced carrier frequency=w5, coerced gain=w6, Error Out=w7)
  call "niUSRP Initiate.gvi"(session handle=w3, error in (no error)=w7) -> (session handle out=w8, Error Out=w9)
  call "niUSRP Fetch Rx Data (CDB).gvi"(session handle=w8, number of samples=$"number of samples", timeout=$timeout, error in (no error)=w9) -> (session handle out=w10, data=w11, Error Out=w12)
  call "niUSRP Abort.gvi"(Handle in=w10, error in (no error)=w12) -> (Handle out=w13, Error Out=w14)
  call "niUSRP Close Session.gvi"(handle in=w13, error in=w14) -> (error out=w15)
  $"Error Out" <- w15
  Reciprocal(x=w4) -> w16
  Property Node(instance in=waveform<c128> {dt=1, Y=[]}, "Y"=w11, "dt"=w16) -> (instance out=w17)
  call "Power Spectrum for 1 Chan (CDB).gvi"(signal=w17) -> (power spectrum=w18)
  $"Frequency Plot" <- w18
  $"coerced IQ rate" <- w4
  $"coerced frequency" <- w5
  $"coerced gain" <- w6
