vi "FindTestFreq.gvi"   [LabVIEW Communications System Design Software 2.0.1]
inputs:
  "RX Parameters In": T1
outputs:
  "Frame Parameters Out": T3
  "Samples per Acquisition": i64
  "Test Carrier Frequencies": f64[]
panel controls:
  "Frame Parameters": T2
types:
  T1 = cluster{"IQ Sampling Rate [S/sec]": f64, "Gain [dB]": f64, "Active Antenna": string, "Reference Frequency": string, "Timebase Clock Source": string, "Start Carrier [Hz]": f64, "Stop Carrier [Hz]": f64, "Acq Duration [sec]": f64}
  T2 = cluster{"IQ Rate": f64, "Frames": i32, "Length of Subset": i32, "Start Carrier [Hz]": f64, "Stop Carrier [Hz]": f64, "Acq Duration [Sec]": f64, "Start Index of Subset": i32}
  T3 = cluster{"IQ Rate": f64, "Frames": i32, "Length of Subset": i32, "Start Carrier [Hz": f64, "Stop Carrier [Hz]": f64, "Acq Duration [Sec]": f64, "Start Index of Subset": i32}
uses:
  NI::Analysis::Generation::Ramp Pattern by Increment.gvi
diagram:
  Property Node(instance in=$"RX Parameters In") -> ("IQ Sampling Rate [S/sec]"=w1, "Start Carrier [Hz]"=w2, "Stop Carrier [Hz]"=w3, "Acq Duration [sec]"=w4)
  # Acquisition Rate * IQ Sampling Rate
  Multiply(w1, w4) -> w5
  To Long Integer(number=w5) -> w6
  To Quad Integer(number=w6) -> w7
  $"Samples per Acquisition" <- w7
  # IQ Sampling Rate * 0.25
  # w8: IQ Sample Rate / 4
  Multiply(w1, 0.25) -> w8
  # Is the dt variable in Ramp by Increment Waveform important?
  # What happens if it changes?
  call "Ramp Pattern by Increment.gvi"(increment=w8, end=w3, start=w2) -> (ramp pattern=w9, samples=w10)
  # w5: Acq Rate * IQ Sample Rate
  Quotient And Remainder(x=w6, y=4) -> (floor(x/y)=w11)
  # Writing to IQ rate is redundant
  Property Node(instance in=$"Frame Parameters", "IQ Rate"=w1, "Frames"=w10, "Length of Subset"=w11, "Start Index of Subset"=w11, "Start Carrier [Hz]"=w2, "Stop Carrier [Hz]"=w3, "Acq Duration [Sec]"=w4) -> (instance out=w12)
  $"Frame Parameters Out" <- w12
  $"Test Carrier Frequencies" <- w9
