vi "Function_3.gvi"   [LabVIEW Communications System Design Software 2.0.1]
inputs:
  "FFT Power Spectrum": cluster{"f0": f64, "df": f64, "IQ": f64[]}
  "Waterfall Time Scale (s)": i32 = 5
outputs:
  "IQ array size": i32
  "Waterfall Plot": f64[][]
diagram:
  Property Node(instance in=$"FFT Power Spectrum") -> ("IQ"=w1)
  Array Size(array=w1) -> (size(s)=w2)
  $"IQ array size" <- w2
  call "Function_2.gvi"(Magnitude=w1, Number of Samples=w2, Waterfall Time Scale (s)=$"Waterfall Time Scale (s)") -> (Waterfall Plot=w3)
  $"Waterfall Plot" <- w3
