vi "Playback.gvi"   [LabVIEW NXG]
panel controls:
  "file path": path
  "Device names": string = "192.168.10.2"
  "IQ rate": f64 = 200000
  "carrier frequency": f64 = 462562500
  "gain": f64
  "active antenna": string = "TX1"
  "number of samples": i32 = 100000
  "Stop": bool
panel indicators:
  "error out": error
  "Graph": i16[]
diagram:
  w1 = $"number of samples"
  Open Or Create Or Replace File(access (0:read/write)="read-only", file path (use dialog)=$"file path", operation (0:open)="open") -> (error out=w2, refnum out=w3)  # Open/Create/Replace File
  Get File Size(error in=w2, file=w3) -> (error out=w4, refnum out=w5)
  Obtain Queue(element data type=i16[] [], error in (no error)=w4) -> (error out=w6, queue out=w7)
  while {
    Read From Binary File(count=w1, data type=i16 0, error in=w6, file (use dialog)=w5) -> (data=w8, error out=w9, refnum out=w10)
    Enqueue Element(element=w8, error in (no error)=w9, queue=w7, timeout in ms (-1)=2000) -> (error out=w11, queue out=w12)
    call "Clear Errors.gvi"(specific error code to clear=4, error in=w11) -> (error out=w13)
    Logical Or(w11, $Stop) -> w14
    stop if w14
  }
  Close File(error in (no error)=w13, refnum=w10) -> (error out=w15)
  call "niUSRP Open Tx Session.gvi"(Device names=$"Device names") -> (Error Out=w16, Session handle=w17)
  call "niUSRP Configure Signal.gvi"(session handle=w17, IQ rate=$"IQ rate", carrier frequency=$"carrier frequency", gain=$gain, error in (no error)=w16, active antenna=$"active antenna") -> (session handle out=w18, Error Out=w19)
  # Shift local ocillator away
  # from center frequency
  Add($"IQ rate", $"carrier frequency") -> w20
  Property Node(instance in=w18, error in=w19, "Configuration:Advanced:Host Data Type"="I16", "Configuration:Advanced:LO Frequency"=w20) -> (instance out=w21, error out=w22)
  w23 = 500  # Time to Buffer
  Merge Errors(w22, w6) -> (error out=w24)
  # want at least 2 elements
  # in queue before beginnging
  sequence {
    frame 0 {
      Wait Ms(msToWait=w23)
    }
  }
  while {
    Dequeue Element(error in (no error)=w24, queue=w7, timeout in ms (-1)=3000) -> (element=w25, error out=w26, queue out=w27)
    $Graph <- w25
    Get Queue Status(error in (no error)=w26, queue=w27) -> (# elements in queue=w28, error out=w29, queue out=w30)
    Is Equal To 0(x=w28) -> w31
    call "niUSRP Write Tx Data (I16).gvi"(session handle=w21, data=w25, end of data?=w31, error in (no error)=w29) -> (session handle out=w32, Error Out=w33)
    Logical Or(w33, w31, $Stop) -> w34
    stop if w34
  }
  call "niUSRP Close Session.gvi"(Handle in=w32, error in (no error)=w33) -> (Error Out=w35)
  Release Queue(error in (no error)=w35, queue=w30) -> (error out=w36)
  Merge Errors(w36, w15) -> (error out=w37)
  sequence {
    frame 0 {
      call "Simple Error Handler.gvi"(error in=w37) -> (error out=w38)
      $"error out" <- w38
      $Stop <- FALSE
    }
  }
