vi "Record.gvi"   [LabVIEW NXG]
panel controls:
  "Device names": string = "192.168.10.2"
  "file path": path
  "number of samples": i64 = 100000
  "IQ rate": f64 = 200000
  "carrier frequency": f64 = 462562500
  "gain": f64
  "active antenna": string = "RX1"
  "Stop": bool
panel indicators:
  "error out": error
  "Graph": i16[]
diagram:
  Open Or Create Or Replace File(access (0:read/write)="write-only", file path (use dialog)=$"file path", operation (0:open)="replace or create") -> (error out=w1, refnum out=w2)  # Open/Create/Replace File
  Obtain Queue(element data type=i16[] [], error in (no error)=w1) -> (error out=w3, queue out=w4)
  call "niUSRP Open Rx Session.gvi"(Device names=$"Device names") -> (Error Out=w5, Session handle=w6)
  call "niUSRP Configure Signal.gvi"(session handle=w6, IQ rate=$"IQ rate", carrier frequency=$"carrier frequency", gain=$gain, error in (no error)=w5, active antenna=$"active antenna") -> (session handle out=w7, Error Out=w8)
  # Shift local ocillator away
  # from center frequency
  Add($"IQ rate", $"carrier frequency") -> w9
  Property Node(instance in=w7, error in=w8, "Configuration:Advanced:Host Data Type"="I16", "Configuration:Advanced:LO Frequency"=w9) -> (instance out=w10, error out=w11)
  Merge Errors(w11, w3) -> (error out=w12)
  call "niUSRP Initiate.gvi"(session handle=w10, error in (no error)=w12) -> (session handle out=w13, Error Out=w14)
  while {
    Dequeue Element(error in (no error)=w14, queue=w4, timeout in ms (-1)=3000) -> (element=w15, error out=w16, queue out=w17, timed out?=w18)
    Write To Binary File(data=w15, error in=w16, file (use dialog)=w2, prepend=FALSE) -> (error out=w19, refnum out=w20)
    Get Queue Status(error in (no error)=w19, queue=w17) -> (error out=w21, queue out=w22)
    Logical Or(w21, w18) -> w23
    stop if w23
  }
  Release Queue(error in (no error)=w21, queue=w22) -> (error out=w24)
  Close File(error in (no error)=w24, refnum=w20) -> (error out=w25)
  w26 = $"number of samples"
  while {
    call "niUSRP Fetch Rx Data (I16).gvi"(session handle=w13, number of samples=w26, error in (no error)=w14) -> (session handle out=w27, data=w28, Error Out=w29)
    $Graph <- w28
    Enqueue Element(element=w28, error in (no error)=w29, queue=w4, timeout in ms (-1)=2000) -> (error out=w30, queue out=w31)
    Logical Or(w30, $Stop) -> w32
    stop if w32
  }
  call "niUSRP Abort.gvi"(Handle in=w27, error in (no error)=w30) -> (Handle out=w33, Error Out=w34)
  call "niUSRP Close Session.gvi"(Handle in=w33, error in (no error)=w34) -> (Error Out=w35)
  Merge Errors(w35, w25) -> (error out=w36)
  call "Simple Error Handler.gvi"(error in=w36) -> (error out=w37)
  $"error out" <- w37
