vi "Rx Continuous Waterfall.gvi"   [LabVIEW Communications System Design Suite 2.0.1]
panel controls:
  "IQ Rate [S/sec]": f64 = 1000000
  "Carrier Frequency": f64 = 2000000000
  "Gain": f64 = 1
  "Active Antenna": string = "RX1"
  "Number of Samples": i64 = 16384
  "Timeout": f64 = 10
  "Enabled Channels": string = "0"
  "Stop": bool
  "Device ID": "niUSRPClass"
  "Waterfall Time Scale (s)": i32 = 5
panel indicators:
  "Coerced IQ Rate [S/sec]": f64
  "Coerced Carrier Frequency": f64
  "Coerced Gain": f64
  "Baseband Power Spectrum": T1
  "Waterfall Plot": f64[][]
types:
  T1 = cluster{"f0": f64, "df": f64, "magnitude": f64[]}
uses:
  NI::Analysis::Measurement::Power Spectrum for 1 Chan (CDB).gvi
diagram:
  w1 = $"Enabled Channels"
  w2 = $"Waterfall Time Scale (s)"
  w3 = $"Number of Samples"
  call "niUSRP Open Rx Session.gvi"(niUSRP Device=$"Device ID") -> (error out=w4, session handle out=w5)
  Property Node(instance in=w5, "Enabled Channels"=w1, error in=w4) -> (error out=w6, instance out=w7)
  call "niUSRP Configure Signal.gvi"(session handle=w7, IQ rate=$"IQ Rate [S/sec]", carrier frequency=$"Carrier Frequency", gain=$Gain, error in (no error)=w6, channel list=w1, active antenna=$"Active Antenna") -> (session handle out=w8, coerced IQ rate=w9, coerced carrier frequency=w10, coerced gain=w11, Error Out=w12)
  call "niUSRP Initiate.gvi"(session handle=w8, error in (no error)=w12) -> (session handle out=w13, Error Out=w14)
  # Send configuration settings to the USRP
  # and read the coerced values back.
  # Stop and close the USRP session.
  s1 = w14  # shift register
  while (iteration -> i1) {
    # Continuously read and graph I/Q data and spectrum.
    call "niUSRP Fetch Rx Data (CDB WDT).gvi"(session handle=w13, number of samples=w3, timeout=$Timeout, error in (no error)=s1, channel list=w1) -> (session handle out=w15, data=w16, Error Out=w17)
    Quotient And Remainder(x=i1, y=1) -> (x-y*floor(x/y)=w18)
    case (w18) {
      frame Default { }
      frame 0 {
        To Long Integer(number=w3) -> w19
        Multiply(10, w2) -> w20
        call "Power Spectrum for 1 Chan (CDB).gvi"(signal=w16, dB on=TRUE) -> (power spectrum=w21)
        Property Node(instance in=w21) -> ("magnitude"=w22)
        Is First Call() -> w23
        case (w23) {
          frame False, Default {
            w24 = default
          }
          frame True {
            Initialize Array(element=-120, size=w19, size=w20) -> w24
          }
        }
        Feedback Node(initial value=w24, input=w25) -> w26
        Insert Into Array(inArray=w26, index1=0, new=w22) -> w27
        Delete From Array(inArray=w27, length (1)=w19, index1=w20) -> w25
        $"Waterfall Plot" <- w25
        $"Baseband Power Spectrum" <- w21
      }
    }
    Logical Or(w17, $Stop) -> w28
    next s1 = w17
    stop if w28
  }
  call "niUSRP Abort.gvi"(Handle in=w15, error in (no error)=s1) -> (Handle out=w29, Error Out=w30)
  call "niUSRP Close Session.gvi"(handle in=w29, error in=w30) -> (error out=w31)
  call "Simple Error Handler.gvi"(error in=w31)
  $"Coerced IQ Rate [S/sec]" <- w9
  $"Coerced Carrier Frequency" <- w10
  $"Coerced Gain" <- w11
