vi "Save Data.gvi"   [LabVIEW Communications System Design Software 2.0.1]
inputs:
  "file path": path
  "FFT Power Spectrum": cluster{"f0": f64, "df": f64, "IQ": f64[]}
outputs:
  "tdms file out": TDMSFileRefnum
diagram:
  Is First Call() -> w1
  case (w1) {
    frame False, Default {
      w2 = default
    }
    frame True {
      TDMS Open(disable buffering=TRUE, file path=$"file path", operation="create") -> (tdms file out=w2)
    }
  }
  Property Node(instance in=$"FFT Power Spectrum") -> ("f0"=w3, "df"=w4, "IQ"=w5)
  To Time Stamp(number=w3) -> w6
  Build Waveform Node(Y=w5, dt=w4, t0=w6) -> (output waveform=w7)
  TDMS Write(data=w7, tdms file=w2) -> (tdms file out=w8)
  $"tdms file out" <- w8
