vi "Aggregate Spectrum_LO.gvi"   [LabVIEW Communications System Design Software 2.0.1]
panel controls:
  "Gain (dB)": f64
  "Device Names": string = "192.168.10.2"
  "Start Frequency": f64
  "Interval (IQ Rate)": f64
  "Active Antenna": string = "RX1"
  "End Frequency": f64
  "Number of Samples": i64 = 16384
  "Timeout": f64 = 10
  "Stop": bool
panel indicators:
  "Error Out": error
  "loop iteration": i32
  "Baseband Power Spectrum": T1
  "Coerced Frequency": f64
  "Coerced Gain": f64
  "coerced IQ rate": f64
  "IQ Graph": waveform<f64>[]
  "LO Frequency": f64
types:
  T1 = cluster{"f0": f64, "df": f64, "magnitude": f64[]}
uses:
  NI::Analysis::Measurement::Power Spectrum for 1 Chan (CDB).gvi
diagram:
  # 10000000: 25M/2
  Add($"Start Frequency", 10000000) -> w1
  call "niUSRP Open Rx Session.gvi"(device names=$"Device Names") -> (error out=w2, session handle out=w3)
  call "niUSRP Configure Signal.gvi"(session handle=w3, IQ rate=$"Interval (IQ Rate)", carrier frequency=$"Start Frequency", gain=$"Gain (dB)", error in=w2, active antenna=$"Active Antenna") -> (session handle out=w4, error out=w5)
  Property Node(instance in=w4, "LO Frequency"=w1, error in=w5) -> ("LO Frequency"=w6, error out=w7, instance out=w8)
  call "niUSRP Initiate.gvi"(session handle=w8, error in=w7) -> (session handle out=w9, error out=w10)
  s1 = w6  # shift register
  while (iteration -> i1) {
    call "Update Properties.gvi"(niusrp in_2=w9, error in=w10, Start Frequency=$"Start Frequency", End Frequency=$"End Frequency", Interval (IQ Rate)=$"Interval (IQ Rate)", Loop Iteration=i1, LO Frequency=s1) -> (complete=w11, Usrp.niUSRPClass=w12, Error=w13)
    call "niUSRP Fetch Rx Data (CDB WDT).gvi"(session handle=w12, number of samples=$"Number of Samples", timeout=$Timeout, error in=w13) -> (session handle out=w14, data=w15, error out=w16)
    Property Node(instance in=w14, error in=w16) -> ("IQ Rate"=w17, "Carrier Frequency"=w18, "Gain"=w19, "LO Frequency"=w20, error out=w21, instance out=w22)
    $"coerced IQ rate" <- w17
    $"Coerced Frequency" <- w18
    $"Coerced Gain" <- w19
    # I'm not sure what you were trying to do with
    # the magnitude graph so I removed it temporarily.
    Logical Or(w21, w11, $Stop) -> w23
    # There are different Rx blocks that output
    # the data in different forms. I changed your
    #  read block to CDB WDT (complex
    # double analog waveform)
    call "Power Spectrum for 1 Chan (CDB).gvi"(signal=w15, dB on=TRUE, restart averaging=TRUE) -> (power spectrum=w24)
    $"Baseband Power Spectrum" <- w24
    $"LO Frequency" <- w20
    Property Node(instance in=w15) -> ("Y"=w25, "dt"=w26)
    Complex To Real Imaginary(x + iy=w25) -> (x=w27, y=w28)
    Build Waveform Node(Y=w27, dt=w26) -> (output waveform=w29)
    Build Waveform Node(Y=w28, dt=w26) -> (output waveform=w30)
    Build Array(w29, w30) -> w31
    $"IQ Graph" <- w31
    $"loop iteration" <- i1
    next s1 = w20
    stop if w23
  }
  call "niUSRP Abort.gvi"(session handle=w22, error in=w21) -> (session handle out=w32, error out=w33)
  call "niUSRP Close Session.gvi"(session handle=w32, error in=w33) -> (error out=w34)
  $"Error Out" <- w34
