vi "Update Properties.gvi"   [LabVIEW Communications System Design Software 2.0.1]
inputs:
  "niusrp in_2": "niUSRPClass"
  "error in": error
  "Start Frequency": f64
  "End Frequency": f64
  "Interval (IQ Rate)": f64
  "Loop Iteration": i32
  "LO Frequency": f64
outputs:
  "complete": bool
  "Usrp.niUSRPClass": "niUSRPClass"
  "Error": error
diagram:
  Multiply($"Interval (IQ Rate)", $"Loop Iteration") -> w1
  # w2: updated carrier freq
  Add($"Start Frequency", w1) -> w2
  Subtract(x=w2, y=$"LO Frequency") -> w3
  Absolute Value(x=w3) -> w4
  Is Greater(x=w4, y=10000000) -> w5
  case (w5) {
    frame False, Default {
      Property Node(instance in=$"niusrp in_2", "IQ Rate"=$"Interval (IQ Rate)", "Carrier Frequency"=w2, error in=$"error in") -> (error out=w7, instance out=w6)
    }
    frame True {
      Add(w2, 10000000) -> w8
      Property Node(instance in=$"niusrp in_2", "IQ Rate"=$"Interval (IQ Rate)", "Carrier Frequency"=w2, "LO Frequency"=w8, error in=$"error in") -> (error out=w7, instance out=w6)
    }
  }
  $"Usrp.niUSRPClass" <- w6
  $Error <- w7
  Is Greater(x=w2, y=$"End Frequency") -> w9
  # w5: Update LO?
  $complete <- w9
