vi "Subsetup - Hardware RX Parameters.gvi"   [LabVIEW Communications System Design Software 2.0.1]
inputs:
  "RX Parameters In": T1
  "IVI Refnum In": "niUSRPClass"
  "error in (no error)": error
outputs:
  "RX Parameters Out": T1
  "IVI Refnum Out": "niUSRPClass"
  "error out": error
panel indicators:
  "Reference Frequency Source_2": string
  "Timebase Clock Source_2": string
types:
  T1 = cluster{"IQ Sampling Rate [S/sec]": f64, "Gain [dB]": f64, "Active Antenna": string, "Reference Frequency": string, "Timebase Clock Source": string, "Start Carrier [Hz]": f64, "Stop Carrier [Hz]": f64, "Acq Duration [sec]": f64}
diagram:
  Property Node(instance in=$"RX Parameters In") -> ("IQ Sampling Rate [S/sec]"=w1, "Gain [dB]"=w2, "Active Antenna"=w3, "Reference Frequency"=w4, "Timebase Clock Source"=w5)
  Property Node(instance in=$"IVI Refnum In", sub-item="0", "IQ Rate"=w1, "Gain"=w2, "Active Antenna"=w3, "Reference Frequency Source"=w4, "Timebase Clock Source"=w5, error in=$"error in (no error)") -> ("IQ Rate"=w6, "Carrier Frequency"=w7, error out=w8, instance out=w9)
  $"IVI Refnum Out" <- w9
  $"error out" <- w8
  Property Node(instance in=$"RX Parameters In", "IQ Sampling Rate [S/sec]"=w6, "Gain [dB]"=w7) -> (instance out=w10)
  $"RX Parameters Out" <- w10
