vi "USRP Plot Spectrum.gvi"   [LabVIEW Communications System Design Software 2.0.1]
inputs:
  "Frame Parameters": T4
  "Display": T3 = {"display unit"="Vrms", "dB type"="dB"}
  "Window Properties": T1 = {"eq noise BW"=1, "coherent gain"=1}
  "Spectrum to Plot In": cluster{"f0": f64, "df": f64, "IQ": f64[]}
outputs:
  "Spectrum to Plot Out": cluster{"f0": f64, "df": f64, "IQ": f64[]}
panel controls:
  "Spectrum to Plot Initialize": cluster{"f0": f64, "df": f64, "IQ": f64[]}
types:
  T1 = cluster{"eq noise BW": f64, "coherent gain": f64}
  T2 = enum{"Vrms", "Vpk", "Vrms^2", "Vpk^2", "Vrms/rtHz", "Vpk/rtHz", "Vrms^2/Hz", "Vpk^2/Hz"}
  T3 = cluster{"display unit": T2, "dB type": enum{"Linear", "dB", "dBm"}}
  T4 = cluster{"IQ Rate": f64, "Frames": i32, "Length of Subset": i32, "Start Carrier [Hz": f64, "Stop Carrier [Hz]": f64, "Acq Duration [Sec]": f64, "Start Index of Subset": i32}
uses:
  NI::Analysis::Measurement::Spectrum Unit Conversion.gvi
diagram:
  Property Node(instance in=$"Spectrum to Plot In") -> ("df"=w1, "IQ"=w2)
  Property Node(instance in=$Display) -> ("display unit"=w3, "dB type"=w4)
  call "Spectrum Unit Conversion.gvi"(spectrum in=w2, spectrum type="Power (Vrms^2)", dB type=w4, display unit=w3, df=w1, window constants=$"Window Properties") -> (spectrum out=w5)
  Property Node(instance in=$"Frame Parameters") -> ("Start Carrier [Hz"=w6, "Start Index of Subset"=w7)
  Multiply(w7, w1) -> w8
  Subtract(x=w6, y=w8) -> w9
  Property Node(instance in=$"Spectrum to Plot Initialize", "f0"=w9, "df"=w1, "IQ"=w5) -> (instance out=w10)
  $"Spectrum to Plot Out" <- w10
