vi "USRP_NI_IQ.gvi"   [LabVIEW Communications System Design Software 2.0.1]
inputs:
  "IVI Refnum In": "niUSRPClass"
  "error in": error
  "Number of Samples": i64
  "Carrier Frequency": f64
  "Active Antenna": string
outputs:
  "IVI Refnum Out": "niUSRPClass"
  "error out": error
  "data": c128[]
  "Carrier Freq Out": f64
  "timestamp": T1
panel indicators:
  "Usrp.niUSRPClass": "niUSRPClass"
types:
  T1 = cluster{"whole seconds": u64, "fractional seconds": f64}
diagram:
  case ($"error in") {
    frame No Error, Default {
      Property Node(instance in=$"IVI Refnum In", "Number of Samples Is Finite"=TRUE, "Number of Samples"=$"Number of Samples", "Carrier Frequency"=$"Carrier Frequency", "Active Antenna"=$"Active Antenna", error in=$"error in") -> (error out=w6, instance out=w7)
      call "niUSRP Commit.gvi"(session handle=w7, error in=w6) -> (session handle out=w8, error out=w9)
      call "niUSRP Initiate.gvi"(session handle=w8, error in=w9) -> (session handle out=w10, error out=w11)
      call "niUSRP Fetch Rx Data (CDB).gvi"(session handle=w10, number of samples=$"Number of Samples", error in=w11) -> (session handle out=w12, data=w2, timestamp=w5, error out=w13)
      call "niUSRP Abort.gvi"(session handle=w12, error in=w13) -> (session handle out=w3, error out=w1)
      w4 = $"Carrier Frequency"
    }
    frame Error {
      $"Usrp.niUSRPClass" <- $"IVI Refnum In"
      w1 = $"error in"
      w2 = c128[] []
      w3 = $"IVI Refnum In"
      w4 = $"Carrier Frequency"
      w5 = T1 {all zero or empty}
    }
  }
  $"IVI Refnum Out" <- w3
  $"error out" <- w1
  $data <- w2
  $timestamp <- w5
  $"Carrier Freq Out" <- w4
