vi "Waterfall Plotter.gvi"   [LabVIEW Communications System Design Software 2.0.1]
inputs:
  "Waterfall Time Scale": i32
  "FFT Power Spectrum": cluster{"f0": f64, "df": f64, "IQ": f64[]}
outputs:
  "Waterfall Plot": f64[][]
diagram:
  Property Node(instance in=$"FFT Power Spectrum") -> ("IQ"=w1)
  # w2: Number of Samples
  Array Size(array=w1) -> (size(s)=w2)
  Multiply(10, $"Waterfall Time Scale") -> w3
  Is First Call() -> w4
  case (w4) {
    frame False, Default {
      w5 = default
    }
    frame True {
      Initialize Array(element=-120, size=w2, size=w3) -> w5
    }
  }
  Feedback Node(initial value=w5, input=w6) -> w7
  Insert Into Array(inArray=w7, index1=0, new=w1) -> w8
  Delete From Array(inArray=w8, length (1)=w2, index1=w3) -> w6
  $"Waterfall Plot" <- w6
