vi "testrecord.gvi"   [LabVIEW Communications System Design Software 2.0.1]
panel controls:
  "loop count": i32
panel indicators:
  "size(s)": i32
  "Array": string[]
uses:
  NI::Analysis::Generation::Square Waveform.gvi
  NI::Analysis::Generation::Sine Waveform.gvi
diagram:
  call "Square Waveform.gvi"() -> (square wave=w1)
  call "Sine Waveform.gvi"() -> (sine wave=w2)
  w3 = $"loop count"
  Get Component Directory() -> (Path=w4)
  # cwd
  Build Path(base path=w4, name or relative path=path "test_data.tdms") -> (appended path=w5)
  TDMS Open(file path=w5, operation="create or replace") -> (error out=w6, tdms file out=w7)
  for (N = w3) (iteration -> i1) {
    Build Array(w1, w2) -> w8
    Format Into String(initString="Group", i1) -> w9
    Array Size(array=w8) -> (size(s)=w10)
    for (N = w10) (iteration -> i2) {
      Format Into String(initString="Channel", i2) -> w12
      append w12 to w11
    }
    TDMS Write(channel name(s) in=w11, data=w8, error in=w6, group name in=w9, tdms file=w7) -> (error out=w13, tdms file out=w14)
    $"size(s)" <- w10
    # I read this is the best way
    # to initialize arrays.
    $Array <- w11
  }
  TDMS Close(error in=w13, tdms file=w14) -> (error out=w15)
  call "Display Error.gvi"(error in=w15)
